# Grasshopper definition GHtoHoudini.ghx (Grasshopper 1.0.7)
# plug-ins: Kangaroo Components

crv = Curve(<curve referenced from the Rhino model>)
divide = DivideCurve(Curve=crv, Count=Slider(10, range=0..100), Kinks=False)  # -> Points, Tangents, Parameters

Z = UnitZ(Factor=1)
xprod = CrossProduct(VectorA=divide.Tangents, VectorB=Z, Unitize=False)  # -> Vector, Length
unit = UnitVector(Vector=xprod.Vector)
multiplication = Multiplication(A=unit, B=Slider(30, range=1..100))
dispatch = Dispatch(List=divide.Points, DispatchPattern=[True, False])  # -> ListA, ListB
dispatch_2 = Dispatch(List=multiplication, DispatchPattern=[True, False])  # -> ListA, ListB
neg = Negative(Value=dispatch_2.ListB)
move = Move(Geometry=dispatch.ListA, Motion=dispatch_2.ListA)  # -> Geometry, Transform
move_2 = Move(Geometry=dispatch.ListB, Motion=neg)  # -> Geometry, Transform
weave = Weave(Pattern=[0, 1], Stream0=move.Geometry, Stream1=move_2.Geometry, NullGaps=False)

X = UnitX(Factor=1)
field_size = Panel("1000")

field_size_2 = Panel("1000")
division = Division(A=field_size_2, B=2)
neg_2 = Negative(Value=division)
dom = ConstructDomain(DomainStart=neg_2, DomainEnd=division)
rectangle = Rectangle(Plane=PlaneXY(0, 0, 0), XSize=dom, YSize=dom, Radius=0)  # -> Rectangle, Length

d = Slider(3, range=1..100)
shatter = Shatter(Curve=crv, Parameters=divide.Parameters)
eval = EvaluateCurve(Curve=reparameterize(shatter), Parameter=Slider(0.5, range=0..1))  # -> Point, Tangent, Angle
dispatch_3 = Dispatch(List=eval.Tangent, DispatchPattern=[True, False])  # -> ListA, ListB
neg_3 = Negative(Value=dispatch_3.ListB)
rec = Rectangle(rectangle.Rectangle)

number_slider = Slider(5, range=0..10)
division_2 = Division(A=Slider(66, range=1..180), B=2)
rad = Radians(Degrees=division_2)
area = Area(Geometry=rec)  # -> Area, Centroid
series = Series(Start=0, Step=number_slider, Count=10)
X_2 = UnitX(Factor=series)
tan = Tangent(Value=rad)
move_3 = Move(Geometry=area.Centroid, Motion=X_2)  # -> Geometry, Transform
division_3 = Division(A=number_slider, B=tan)
dispatch_4 = Dispatch(List=move_3.Geometry, DispatchPattern=[True, False])  # -> ListA, ListB
Y = UnitY(Factor=division_3)
move_4 = Move(Geometry=dispatch_4.ListB, Motion=Y)  # -> Geometry, Transform
weave_2 = Weave(Pattern=[0, 1], Stream0=dispatch_4.ListA, Stream1=move_4.Geometry, NullGaps=False)
pline = PolyLine(Vertices=weave_2, Closed=False)
divide_2 = DivideCurve(Curve=pline, Count=Slider(25, range=0..100), Kinks=False)  # -> Points, Tangents, Parameters
height_m = Slider(5, range=0..10)
diameter_m = Slider(0.1, range=0..10)
Z_2 = UnitZ(Factor=1)
line = LineSDL(Start=divide_2.Points, Direction=Z_2, Length=height_m)
division_4 = Division(A=diameter_m, B=2)
pipe = Pipe(Curve=line, Radius=division_4, Caps=1)
txt = Text("sequence_column_zigzag_div25_h5_d01_cap.iges")
geo = Geometry(pipe)
merge = Merge(Data1=simplify(txt), Data2=simplify(geo))  # -> flatten(Result)
data = Data(merge)

area_2 = Area(Geometry=rec)  # -> Area, Centroid
line_2 = LineSDL(Start=area_2.Centroid, Direction=X, Length=Slider(30, range=0..100))
divide_3 = DivideCurve(Curve=line_2, Count=Slider(10, range=0..10), Kinks=False)  # -> Points, Tangents, Parameters
dispatch_5 = Dispatch(List=shatter, DispatchPattern=[True, False])  # -> ListA, ListB

number_slider_2 = Slider(5, range=0..10)
step = Slider(20, range=0..20)
n = Slider(10, range=0..50)
step_2 = Slider(20, range=0..20)
area_3 = Area(Geometry=rec)  # -> Area, Centroid
box = CenterBox(
    Base=area_3.Centroid,
    X=expr("x/2", Slider(1, range=0..10)),
    Y=expr("x/2", Slider(10, range=0..50)),
    Z=expr("x/2", number_slider_2))
division_5 = Division(A=number_slider_2, B=2)
Z_3 = UnitZ(Factor=division_5)
move_5 = Move(Geometry=box, Motion=Z_3)  # -> Geometry, Transform
txt_2 = Text("sequence_box_x1_y10_z5_s10_n20_dirxy.iges")
series_2 = Series(Start=0, Step=step, Count=n)
series_3 = Series(Start=0, Step=step_2, Count=n)
Y_2 = UnitY(Factor=series_2)
X_3 = UnitX(Factor=series_3)
move_6 = Move(Geometry=move_5.Geometry, Motion=Y_2)  # -> Geometry, Transform
move_7 = Move(Geometry=move_6.Geometry, Motion=X_3)  # -> Geometry, Transform
geo_2 = Geometry(move_7.Geometry)
merge_2 = Merge(Data1=simplify(txt_2), Data2=simplify(geo_2))  # -> flatten(Result)
data_2 = Data(merge_2)

xprod_2 = CrossProduct(VectorA=neg_3, VectorB=Z, Unitize=False)  # -> Vector, Length
xprod_3 = CrossProduct(VectorA=dispatch_3.ListA, VectorB=Z, Unitize=False)  # -> Vector, Length
diameter_m_2 = Slider(0.1, range=0..10)

height_m_2 = Slider(5, range=0..10)
area_4 = Area(Geometry=rec)  # -> Area, Centroid
Z_4 = UnitZ(Factor=1)
line_3 = LineSDL(Start=area_4.Centroid, Direction=Z_4, Length=height_m_2)
division_6 = Division(A=diameter_m_2, B=2)
pipe_2 = Pipe(Curve=line_3, Radius=division_6, Caps=0)
txt_3 = Text("column_n1_h5_d01.iges")
geo_3 = Geometry(pipe_2)
merge_3 = Merge(Data1=simplify(txt_3), Data2=simplify(geo_3))  # -> flatten(Result)
data_3 = Data(merge_3)

number_slider_3 = Slider(5, range=0..10)
area_5 = Area(Geometry=rec)  # -> Area, Centroid
box_2 = CenterBox(
    Base=area_5.Centroid,
    X=expr("x/2", Slider(1, range=0..10)),
    Y=expr("x/2", Slider(50, range=0..50)),
    Z=expr("x/2", number_slider_3))
division_7 = Division(A=number_slider_3, B=2)
Z_5 = UnitZ(Factor=division_7)
move_8 = Move(Geometry=box_2, Motion=Z_5)  # -> Geometry, Transform
txt_4 = Text("box_x1_y50_z5.iges")
merge_4 = Merge(Data1=simplify(txt_4), Data2=simplify(move_8.Geometry))  # -> flatten(Result)
data_4 = Data(merge_4)

area_6 = Area(Geometry=rec)  # -> Area, Centroid
cyl = Cylinder(Base=area_6.Centroid, Radius=Slider(5, range=0..10), Length=Slider(5, range=0..10))
offset = OffsetSurface(Surface=cyl, Distance=expr("-x", Slider(0.1, range=0..10)), Retrim=True)
cap = CapHoles(Brep=cyl)
cap_2 = CapHoles(Brep=offset)
txt_5 = Text("single_tube_r5_l5_d01.iges")
sdiff = SolidDifference(BrepsA=cap, BrepsB=cap_2)
merge_5 = Merge(Data1=simplify(txt_5), Data2=simplify(cyl))  # -> flatten(Result)
data_5 = Data(merge_5)

area_7 = Area(Geometry=rec)  # -> Area, Centroid
cyl_2 = Cylinder(Base=area_7.Centroid, Radius=Slider(5, range=0..10), Length=Slider(3, range=0..10))
offset_2 = OffsetSurface(Surface=cyl_2, Distance=expr("-x", Slider(0.1, range=0..10)), Retrim=True)
cap_3 = CapHoles(Brep=cyl_2)
cap_4 = CapHoles(Brep=offset_2)
txt_6 = Text("single_arc_r5_l3_d01.iges")
xz = XZPlane(Origin=Point(0, 0, 0))
sdiff_2 = SolidDifference(BrepsA=cap_3, BrepsB=cap_4)
planesrf = PlaneSurface(Plane=xz, XSize=Domain(-10, 10), YSize=Domain(-10, 10))
split = SplitBrep(Brep=cyl_2, Cutter=planesrf)
item = ListItem(List=split, Index=0, Wrap=True)
merge_6 = Merge(Data1=simplify(txt_6), Data2=simplify(item))  # -> flatten(Result)
data_6 = Data(merge_6)

r = Slider(10, range=3..10)
a = Slider(30, range=0..180)
h = Slider(3, range=0..10)
d_2 = Slider(0.1, range=0..10)
area_8 = Area(Geometry=rec)  # -> Area, Centroid
rad_2 = Radians(Degrees=a)
arc = Arc(Plane=area_8.Centroid, Radius=r, Angle=rad_2)  # -> Arc, Length
end = EndPoints(Curve=arc.Arc)  # -> Start, End
merge_7 = Merge(Data1=end.Start, Data2=area_8.Centroid, Data3=end.End)
txt_7 = Text("single_tik_r30_a60_h3_d01.iges")
pline_2 = PolyLine(Vertices=merge_7, Closed=False)
offset_3 = OffsetCurve(Curve=pline_2, Distance=d_2, Plane=PlaneXY(0, 0, 0), Corners=1)
end_2 = EndPoints(Curve=offset_3)  # -> Start, End
midpt = CurveMiddle(Curve=offset_3)
merge_8 = Merge(Data1=merge_7, Data2=end_2.End, Data3=midpt, Data4=end_2.Start)
pline_3 = PolyLine(Vertices=flatten(merge_8), Closed=True)
boundary = BoundarySurfaces(Edges=pline_3)
Z_6 = UnitZ(Factor=h)
extr = Extrude(Base=pline_2, Direction=Z_6)
merge_9 = Merge(Data1=simplify(txt_7), Data2=simplify(extr))  # -> flatten(Result)
data_7 = Data(merge_9)

height_m_3 = Slider(5, range=0..10)
diameter_m_3 = Slider(0.1, range=0..10)
step_3 = Slider(2, range=0..10)
n_2 = Slider(50, range=0..50)
area_9 = Area(Geometry=rec)  # -> Area, Centroid
Z_7 = UnitZ(Factor=1)
line_4 = LineSDL(Start=area_9.Centroid, Direction=Z_7, Length=height_m_3)
division_8 = Division(A=diameter_m_3, B=2)
pipe_3 = Pipe(Curve=line_4, Radius=division_8, Caps=0)
series_4 = Series(Start=0, Step=step_3, Count=n_2)
X_4 = UnitX(Factor=series_4)
move_9 = Move(Geometry=pipe_3, Motion=X_4)  # -> Geometry, Transform
txt_8 = Text("sequence_column_n50_s20_h5_d01.iges")
geo_4 = Geometry(move_9.Geometry)
merge_10 = Merge(Data1=simplify(txt_8), Data2=simplify(geo_4))  # -> flatten(Result)
data_8 = Data(merge_10)

number_slider_4 = Slider(5, range=0..10)
step_4 = Slider(20, range=0..20)
n_3 = Slider(10, range=0..50)
step_5 = Slider(20, range=0..20)
area_10 = Area(Geometry=rec)  # -> Area, Centroid
box_3 = CenterBox(
    Base=area_10.Centroid,
    X=expr("x/2", Slider(1, range=0..10)),
    Y=expr("x/2", Slider(10, range=0..50)),
    Z=expr("x/2", number_slider_4))
division_9 = Division(A=number_slider_4, B=2)
Z_8 = UnitZ(Factor=division_9)
move_10 = Move(Geometry=box_3, Motion=Z_8)  # -> Geometry, Transform
txt_9 = Text("sequence_box_x1_y10_z5_s10_n20_dirxy.iges")
series_5 = Series(Start=0, Step=step_4, Count=n_3)
series_6 = Series(Start=0, Step=step_5, Count=n_3)
Y_3 = UnitY(Factor=series_5)
X_5 = UnitX(Factor=series_6)
move_11 = Move(Geometry=move_10.Geometry, Motion=Y_3)  # -> Geometry, Transform
move_12 = Move(Geometry=move_11.Geometry, Motion=X_5)  # -> Geometry, Transform
geo_5 = Geometry(move_12.Geometry)
merge_11 = Merge(Data1=simplify(txt_9), Data2=simplify(geo_5))  # -> flatten(Result)
data_9 = Data(merge_11)

number_slider_5 = Slider(3, range=3..10)
la = Slider(5, range=3..10)
area_11 = Area(Geometry=rec)  # -> Area, Centroid
X_6 = UnitX(Factor=1)
line_5 = LineSDL(Start=area_11.Centroid, Direction=X_6, Length=la)
division_10 = Division(A=la, B=2)
Y_4 = UnitY(Factor=division_10)
neg_4 = Negative(Value=Y_4)
move_13 = Move(Geometry=line_5, Motion=Y_4)  # -> Geometry, Transform
move_14 = Move(Geometry=line_5, Motion=neg_4)  # -> Geometry, Transform
end_3 = EndPoints(Curve=move_13.Geometry)  # -> Start, End
end_4 = EndPoints(Curve=move_14.Geometry)  # -> Start, End
ln = Line(StartPoint=end_3.Start, EndPoint=end_4.Start)
txt_10 = Text("single_c_l5_h3.iges")
merge_12 = Merge(Data1=move_13.Geometry, Data2=ln, Data3=move_14.Geometry)
join = JoinCurves(Curves=merge_12, Preserve=False)
offset_4 = OffsetCurve(Curve=join, Distance=0.1, Plane=PlaneXY(0, 0, 0), Corners=1)
end_5 = EndPoints(Curve=offset_4)  # -> Start, End
end_6 = EndPoints(Curve=join)  # -> Start, End
ln_2 = Line(StartPoint=end_6.Start, EndPoint=end_5.Start)
ln_3 = Line(StartPoint=end_6.End, EndPoint=end_5.End)
merge_13 = Merge(Data1=merge_12, Data2=ln_2, Data3=offset_4, Data4=ln_3)  # -> flatten(Result)
join_2 = JoinCurves(Curves=merge_13, Preserve=False)
boundary_2 = BoundarySurfaces(Edges=join_2)
Z_9 = UnitZ(Factor=number_slider_5)
extr_2 = Extrude(Base=join, Direction=Z_9)
merge_14 = Merge(Data1=simplify(txt_10), Data2=simplify(extr_2))  # -> flatten(Result)
data_10 = Data(merge_14)

number_slider_6 = Slider(5, range=0..10)
division_11 = Division(A=Slider(90, range=1..180), B=2)
rad_3 = Radians(Degrees=division_11)
area_12 = Area(Geometry=rec)  # -> Area, Centroid
series_7 = Series(Start=0, Step=number_slider_6, Count=10)
X_7 = UnitX(Factor=series_7)
tan_2 = Tangent(Value=rad_3)
move_15 = Move(Geometry=area_12.Centroid, Motion=X_7)  # -> Geometry, Transform
division_12 = Division(A=number_slider_6, B=tan_2)
dispatch_6 = Dispatch(List=move_15.Geometry, DispatchPattern=[True, False])  # -> ListA, ListB
Y_5 = UnitY(Factor=division_12)
move_16 = Move(Geometry=dispatch_6.ListB, Motion=Y_5)  # -> Geometry, Transform
weave_3 = Weave(Pattern=[0, 1], Stream0=dispatch_6.ListA, Stream1=move_16.Geometry, NullGaps=False)
cir = Circle(Plane=weave, Radius=Slider(20, range=0..100))
python = GhPythonScript(x=cir)  # -> out, a; inputs x: list
# ---------- python: Python ----------
import ghpythonlib.treehelpers as th

a = []

for i, c in enumerate(x):
    sub = []
    if i == 0:
        pass
    elif i != 0 :
        sub.append(c)
        sub.append(x[i-1])
    a.append(sub)

a = th.list_to_tree(a)
# ---------- end python ----------
item_2 = ListItem(List=python.a, Index=0, Wrap=True)  # -> Item, Item1
tanin = TangentLinesIn(CircleA=item_2.Item, CircleB=item_2.Item1)  # -> Tangent1, Tangent2
shift = ShiftList(List=flatten(cir), Shift=1, Wrap=False)
shift_2 = ShiftList(List=flatten(tanin.Tangent1), Shift=1, Wrap=False)
shift_3 = ShiftList(List=flatten(tanin.Tangent2), Shift=1, Wrap=False)
weave_4 = Weave(Pattern=[0, 1], Stream0=flatten(tanin.Tangent1), Stream1=flatten(tanin.Tangent2), NullGaps=False)
ccx = CurveCurve(CurveA=reparameterize(graft(shift)), CurveB=shift_2)  # -> Points, ParamsA, ParamsB
ccx_2 = CurveCurve(CurveA=reparameterize(graft(shift)), CurveB=shift_3)  # -> Points, ParamsA, ParamsB
dispatch_7 = Dispatch(List=weave_4, DispatchPattern=[True, False, False, True])  # -> ListA, ListB
merge_15 = Merge(Data1=ccx.ParamsA, Data2=ccx_2.ParamsA)  # -> simplify(Result)
pshift = ShiftPaths(Data=merge_15, Offset=-1)
shatter_2 = Shatter(Curve=reparameterize(simplify(graft(shift))), Parameters=pshift)
item_3 = ListItem(List=shatter_2, Index=0, Wrap=True)  # -> Item, Item1, Item2, Item3
geo_6 = Geometry(flatten(item_3.Item3))
line_6 = Line(dispatch_7.ListA)
weave_5 = Weave(Pattern=[0, 1], Stream0=line_6, Stream1=geo_6, NullGaps=False)
clean = CleanTree(RemoveNulls=True, RemoveInvalid=True, RemoveEmpty=False, Tree=weave_5)
join_3 = JoinCurves(Curves=clean, Preserve=False)
offset_5 = OffsetCurve(Curve=join_3, Distance=0.1, Plane=PlaneXY(0, 0, 0), Corners=1)
end_7 = EndPoints(Curve=offset_5)  # -> Start, End
end_8 = EndPoints(Curve=join_3)  # -> Start, End
ln_4 = Line(StartPoint=end_8.Start, EndPoint=end_7.Start)
ln_5 = Line(StartPoint=end_8.End, EndPoint=end_7.End)
merge_16 = Merge(Data1=join_3, Data2=ln_4, Data3=offset_5, Data4=ln_5)  # -> flatten(Result)
join_4 = JoinCurves(Curves=merge_16, Preserve=False)
boundary_3 = BoundarySurfaces(Edges=join_4)
Z_10 = UnitZ(Factor=number_slider_5)
extr_3 = Extrude(Base=join_3, Direction=Z_10)
geo_7 = Geometry(extr_3)
txt_11 = Text("sngle_sequence_wavewall_s5_a90_r30.iges")
merge_17 = Merge(Data1=simplify(txt_11), Data2=simplify(geo_7))  # -> flatten(Result)
data_11 = Data(merge_17)

number_slider_7 = Slider(10, range=0..10)
division_13 = Division(A=Slider(30, range=1..180), B=2)
rad_4 = Radians(Degrees=division_13)
area_13 = Area(Geometry=rec)  # -> Area, Centroid
series_8 = Series(Start=0, Step=number_slider_7, Count=10)
X_8 = UnitX(Factor=series_8)
tan_3 = Tangent(Value=rad_4)
move_17 = Move(Geometry=area_13.Centroid, Motion=X_8)  # -> Geometry, Transform
division_14 = Division(A=number_slider_7, B=tan_3)
dispatch_8 = Dispatch(List=move_17.Geometry, DispatchPattern=[True, False])  # -> ListA, ListB
Y_6 = UnitY(Factor=division_14)
move_18 = Move(Geometry=dispatch_8.ListB, Motion=Y_6)  # -> Geometry, Transform
weave_6 = Weave(Pattern=[0, 1], Stream0=dispatch_8.ListA, Stream1=move_18.Geometry, NullGaps=False)
pline_4 = PolyLine(Vertices=weave_6, Closed=False)
offset_6 = OffsetCurve(Curve=pline_4, Distance=0.1, Plane=PlaneXY(0, 0, 0), Corners=1)
end_9 = EndPoints(Curve=offset_6)  # -> Start, End
end_10 = EndPoints(Curve=pline_4)  # -> Start, End
ln_6 = Line(StartPoint=end_10.Start, EndPoint=end_9.Start)
ln_7 = Line(StartPoint=end_10.End, EndPoint=end_9.End)
merge_18 = Merge(Data1=pline_4, Data2=ln_6, Data3=offset_6, Data4=ln_7)  # -> flatten(Result)
join_5 = JoinCurves(Curves=merge_18, Preserve=False)
boundary_4 = BoundarySurfaces(Edges=join_5)
Z_11 = UnitZ(Factor=number_slider_5)
extr_4 = Extrude(Base=pline_4, Direction=Z_11)
txt_12 = Text("single_sequence_zigzagwall_h5_a30.iges")
geo_8 = Geometry(extr_4)
merge_19 = Merge(Data1=simplify(txt_12), Data2=simplify(geo_8))  # -> flatten(Result)
data_12 = Data(merge_19)

multiplication_2 = Multiplication(A=xprod_2.Vector, B=d)
move_19 = Move(Geometry=dispatch_5.ListB, Motion=multiplication_2)  # -> Geometry, Transform
multiplication_3 = Multiplication(A=xprod_3.Vector, B=d)
move_20 = Move(Geometry=dispatch_5.ListA, Motion=multiplication_3)  # -> Geometry, Transform
weave_7 = Weave(Pattern=[0, 1], Stream0=move_20.Geometry, Stream1=move_19.Geometry, NullGaps=False)
python_2 = GhPythonScript(x=weave_7)  # -> out, a; inputs x: list; same code as python
item_4 = ListItem(List=python_2.a, Index=0, Wrap=True)  # -> Item, Item1

Y_7 = UnitY(Factor=1)
panel = Panel("wind direction")
neg_5 = Negative(Value=Y_7)

end_11 = EndPoints(Curve=item_4.Item)  # -> Start, End
end_12 = EndPoints(Curve=item_4.Item1)  # -> Start, End
pt = Point(end_11.Start)
pt_2 = Point(end_12.End)
ln_8 = Line(StartPoint=pt, EndPoint=pt_2)
vec = Vector(ln_8)
dprod = DotProduct(VectorA=vec, VectorB=neg_5, Unitize=False)
smaller = SmallerThan(FirstNumber=dprod, SecondNumber=0)  # -> SmallerThan, OrEqualTo
dispatch_9 = Dispatch(List=ln_8, DispatchPattern=smaller.SmallerThan)  # -> ListA, ListB
flip = FlipCurve(Curve=dispatch_9.ListB)  # -> Curve, Flag
weave_8 = Weave(Pattern=[0, 1], Stream0=dispatch_9.ListA, Stream1=flip.Curve, NullGaps=False)
Z_12 = UnitZ(Factor=1)
vec_2 = Vector(weave_8)
end_13 = EndPoints(Curve=weave_8)  # -> Start, End
xprod_4 = CrossProduct(VectorA=vec_2, VectorB=Z_12, Unitize=False)  # -> Vector, Length
rad_5 = Radians(Degrees=Slider(30, range=0..100))
number_slider_8 = Slider(100, range=0..100)
vrot = Rotate(Vector=vec_2, Axis=xprod_4.Vector, Angle=rad_5)
end_14 = EndPoints(Curve=move_19.Geometry)  # -> Start, End
rot3d = Rotate3D(Geometry=ln_8, Angle=rad_5, Center=end_13.Start, Axis=xprod_4.Vector)  # -> Geometry, Transform
Z_13 = UnitZ(Factor=1)
weave_9 = Weave(Pattern=[0, 1], Stream0=end_14.Start, Stream1=end_14.End, NullGaps=False)
vdis = VectorDisplay(Anchor=end_13.Start, Vector=vrot)
line_7 = LineSDL(Start=end_13.Start, Direction=vrot, Length=number_slider_8)
line_8 = LineSDL(Start=weave_9, Direction=Z_13, Length=number_slider_8)
shift_4 = ShiftList(List=flatten(line_7), Shift=1, Wrap=False)
shift_5 = ShiftList(List=line_8, Shift=-1, Wrap=False)
llx = LineLine(Line1=flatten(shift_4), Line2=shift_5)  # -> ParamA, ParamB, PointA, PointB
pt_3 = Point(llx.PointB)
pdecon = Deconstruct(Point=pt_3)  # -> XComponent, YComponent, ZComponent
Z_14 = UnitZ(Factor=pdecon.ZComponent)
move_21 = Move(Geometry=move_19.Geometry, Motion=Z_14)  # -> Geometry, Transform
weave_10 = Weave(Pattern=[0, 1], Stream0=move_20.Geometry, Stream1=move_21.Geometry, NullGaps=False)
python_3 = GhPythonScript(x=weave_10)  # -> out, a; inputs x: list; same code as python
shift_6 = ShiftList(List=move_21.Geometry, Shift=-4, Wrap=False)
item_5 = ListItem(List=python_3.a, Index=0, Wrap=True)  # -> Item, Item1
end_15 = EndPoints(Curve=item_5.Item)  # -> Start, End
end_16 = EndPoints(Curve=item_5.Item1)  # -> Start, End
pt_4 = Point(end_15.Start)
pt_5 = Point(end_16.End)
ln_9 = Line(StartPoint=pt_4, EndPoint=pt_5)
clean_2 = CleanTree(RemoveNulls=True, RemoveInvalid=True, RemoveEmpty=False, Tree=flatten(ln_9))
dupln = RemoveDuplicateLines(Lines=clean_2, Tolerance=0.01)
shift_7 = ShiftList(List=dupln, Shift=-2, Wrap=False)
merge_20 = Merge(Data1=shift_6, Data2=shift_7, Data3=move_20.Geometry)  # -> flatten(Result)
join_6 = JoinCurves(Curves=merge_20, Preserve=False)
project = Project(Geometry=join_6, Plane=PlaneXY(0, 0, 0))  # -> Geometry, Transform
Z_15 = UnitZ(Factor=Slider(1, range=0..1))
move_22 = Move(Geometry=project.Geometry, Motion=expr("-x", Z_15))  # -> Geometry, Transform
merge_21 = Merge(Data1=join_6, Data2=move_22.Geometry)
loft = Loft(Curves=merge_21, Options={Adjust=False, Closed=False, LoftEnds=0, LoftSimp=0, LoftType=0, Rebuild=10, Refit=0.01})
move_23 = Move(Geometry=loft, Motion=Z_15)  # -> Geometry, Transform
offset_7 = OffsetCurve(Curve=join_6, Distance=0.1, Plane=PlaneXY(0, 0, 0), Corners=1)
end_17 = EndPoints(Curve=offset_7)  # -> Start, End
end_18 = EndPoints(Curve=join_6)  # -> Start, End
ln_10 = Line(StartPoint=end_18.Start, EndPoint=end_17.Start)
ln_11 = Line(StartPoint=end_18.End, EndPoint=end_17.End)
merge_22 = Merge(Data1=join_6, Data2=ln_10, Data3=offset_7, Data4=ln_11)  # -> flatten(Result)
join_7 = JoinCurves(Curves=merge_22, Preserve=False)
boundary_5 = BoundarySurfaces(Edges=join_7)
Z_16 = UnitZ(Factor=Slider(3, range=3..10))
extr_5 = Extrude(Base=join_6, Direction=Z_16)
txt_13 = Text("single_sequence_czigzagwall_long_angle.iges")
geo_9 = Geometry(move_23.Geometry)
merge_23 = Merge(Data1=simplify(txt_13), Data2=simplify(geo_9))  # -> flatten(Result)
mesh = MeshBrep(
    Brep=geo_9,
    Settings={GridMaxCount=0, GridMinCount=16, JaggedSeams=False, MaxEdgeLength=0, MinEdgeLength=0.0001, MinTolerance=0, Refine=True, RefineAngle=0, RelativeTolerance=0.65, SimplePlanes=True, Tolerance=0})
tri = Triangulate(Mesh=mesh)  # -> Mesh, Count
data_13 = Data(merge_23)

data_14 = Data(data_13)

# ----
# import obj
panel_2 = Panel("C:\Users\trtku\Data\git\myrepo\sand-report\data\obj\gh_to_houdini\ring2.obj")
path = FilePath("F:\odrive\Google Drive\JH\Projects\[051] GrasshopperHowtos\GH Files\GrasshopperHowtos\0127 GH to Houdini\geo\ring2.obj")
c_script = CSharpScript(file=path, import=Toggle(False), reset=Toggle(False))  # -> out, geometries; inputs file: String, import: Boolean, reset: Boolean
# ---------- c_script: C# usings ----------
using System.Linq;
using Rhino.DocObjects;
# ---------- c_script: C# ----------
    if(import){
      RhinoDoc.ActiveDoc.Objects.UnselectAll();
      string cmd = "!_-Import " + "\"" + file + "\"" + " _Enter";
      Rhino.RhinoApp.RunScript(cmd, false);
      var selectedObjs = RhinoDoc.ActiveDoc.Objects.GetSelectedObjects(false, false).ToList();
      geos = new List<GeometryBase>();
      foreach(RhinoObject selectedObj in selectedObjs){
        var geo = selectedObj.Geometry;
        geos.Add(geo);
        RhinoDoc.ActiveDoc.Objects.Delete(selectedObj, true);
      }
    }
    
    if(reset){
      geos.Clear();
    }
    

    geometries = geos;
# ---------- c_script: C# additional code ----------
  private List<GeometryBase> geos = new List<GeometryBase>();
# ---------- end c_script ----------
geo_10 = Geometry(c_script.geometries)

# ----
# export iges
panel_3 = Panel("C:\Users\trtku\Data\git\myrepo\sand-report\data\iges\")
panel_4 = Panel("C:\Data\git\sand-report\data\iges\")
split_2 = SplitList(List=data_14, Index=1)  # -> ListA, ListB
flatten = FlattenTree(Tree=split_2.ListB, Path="{0}")
path_2 = FilePath(panel_3)

# ----
# transform
# XpYpZp in Rhino
# XpZnYp in Houdi
X_9 = UnitX(Factor=1)
line_9 = LineSDL(Start=Point(0, 0, 0), Direction=X_9, Length=1)
rotax = RotateAxis(Angle=-1.570796327, Axis=line_9)  # -> Geometry, Transform
transform = Transform(Geometry=flatten, Transform=rotax.Transform)

c_script_2 = CSharpScript(geometries=transform, filename=split_2.ListA, directory=path_2, export=Toggle(False))  # inputs geometries: tree of GeometryBase, filename: String, directory: String, export: Boolean
# ---------- c_script_2: C# usings ----------
using System.IO;
# ---------- c_script_2: C# ----------
    if(export){

      var guids = new List<Guid>();

      for(int i = 0; i < geometries.BranchCount; i++){
        for(int n = 0; n < geometries.Branches[i].Count; n++){
          var geom = geometries.Branches[i][n];
          var guid = Rhino.RhinoDoc.ActiveDoc.Objects.Add(geom);
          guids.Add(guid);
        }
      }

      Rhino.RhinoDoc.ActiveDoc.Objects.Select(guids);

      string filepath = Path.Combine(directory, filename);
      string cmd = "_-Export " + "\"" + filepath + "\"" + " _Enter _Enter";

      Rhino.RhinoApp.RunScript(cmd, false);

      Rhino.RhinoDoc.ActiveDoc.Objects.Delete(guids, true);
    }
# ---------- end c_script_2 ----------
