# Grasshopper definition GHtoHoudini_fin.ghx (Grasshopper 1.0.7)

field_size = Panel("1000")
division = Division(A=field_size, B=2)
neg = Negative(Value=division)
dom = ConstructDomain(DomainStart=neg, DomainEnd=division)
rectangle = Rectangle(Plane=PlaneXY(0, 0, 0), XSize=dom, YSize=dom, Radius=0)  # -> Rectangle, Length
rec = Rectangle(rectangle.Rectangle)

projeciton_plane = Panel("""865
1380""")
division_2 = Division(A=projeciton_plane, B=2)
neg_2 = Negative(Value=division_2)
dom_2 = ConstructDomain(DomainStart=neg_2, DomainEnd=division_2)
item = ListItem(List=dom_2, Index=0, Wrap=True)  # -> Item, Item1
rectangle_2 = Rectangle(Plane=PlaneXY(0, 0, 0), XSize=item.Item, YSize=item.Item1, Radius=0)  # -> Rectangle, Length
rec_2 = Rectangle(rectangle_2.Rectangle)

number_slider = Slider(17, range=5..30)
crv = Curve(reparameterize(<curve referenced from the Rhino model>))
divide = DivideCurve(Curve=crv, Count=number_slider, Kinks=False)  # -> Points, Tangents, Parameters
divlength = DivideLength(Curve=crv, Length=Slider(47, range=0..100))  # -> Points, Tangents, Parameters
number_slider_2 = Slider(15, range=1..100)
division_3 = Division(A=Slider(1, range=0..1), B=number_slider)
series = Series(Start=0, Step=division_3, Count=expr("x+1", number_slider))
dispatch = Dispatch(List=divlength.Points, DispatchPattern=[True, False])  # -> ListA, ListB
Z = UnitZ(Factor=1)
graph = GraphMapper(
    series,
    x0=0,
    x1=1,
    y0=0,
    y1=1,
    A=0,
    B=1,
    container_name="Linear",
    Graph_x0=0.2129130661,
    Graph_x1=0.6652608514,
    Graph_y0=1,
    Graph_y1=1)

python = GhPythonScript(x=divlength.Points)  # -> out, a; inputs x: list
# ---------- python: Python ----------
__author__ = "trtku"
__version__ = "2022.12.07"

import ghpythonlib.treehelpers as th

length = 3
factor = int ( len(x) / (length-1) )
print(factor)

a = []
for i in range(factor-1):

    temp = []
    for j in range(length):
        item = x[i*(length-1) + j]
        temp.append(item)
        print(i*(length-1) + j)
    a.append(temp)

a = th.list_to_tree(a)
# ---------- end python ----------
python_2 = GhPythonScript(x=divlength.Tangents)  # -> out, a; inputs x: list; same code as python
item_2 = ListItem(List=python_2.a, Index=0, Wrap=True)  # -> Item, Item1, Item2
item_3 = ListItem(List=python.a, Index=0, Wrap=True)  # -> Item, Item1, Item2
Z_2 = UnitZ(Factor=1)
xprod = CrossProduct(VectorA=item_2.Item1, VectorB=Z_2, Unitize=False)  # -> Vector, Length
multiplication = Multiplication(A=xprod.Vector, B=Slider(58, range=0..100))
move = Move(Geometry=item_3.Item1, Motion=multiplication)  # -> Geometry, Transform
merge = Merge(Data1=item_3.Item, Data2=move.Geometry, Data3=item_3.Item2)
intcrv = Interpolate(Vertices=merge, Degree=3, Periodic=False, KnotStyle=1)  # -> Curve, Length, Domain
Z_3 = UnitZ(Factor=Slider(5, range=0..10))
extr = Extrude(Base=intcrv.Curve, Direction=Z_3)
join = BrepJoin(Breps=flatten(extr))  # -> Breps, Closed

dom_3 = ConstructDomain(DomainStart=0, DomainEnd=number_slider_2)
xprod_2 = CrossProduct(VectorA=divlength.Tangents, VectorB=Z, Unitize=False)  # -> Vector, Length
unit = UnitVector(Vector=xprod_2.Vector)
remap = RemapNumbers(Value=graph, Source=Domain(0, 1), Target=dom_3)  # -> Mapped, Clipped
multiplication_2 = Multiplication(A=unit, B=remap.Mapped)
dispatch_2 = Dispatch(List=multiplication_2, DispatchPattern=[True, False])  # -> ListA, ListB
multiplication_3 = Multiplication(A=dispatch_2.ListB, B=Slider(0, range=0..100))
multiplication_4 = Multiplication(A=dispatch_2.ListA, B=Slider(2, range=0..100))
neg_3 = Negative(Value=multiplication_3)
short = ShortestList(ListA=dispatch.ListB, ListB=neg_3, TrimMode=2)  # -> ListA, ListB
short_2 = ShortestList(ListA=dispatch.ListA, ListB=multiplication_4, TrimMode=2)  # -> ListA, ListB

# ----
# import obj
panel = Panel("C:\Users\trtku\Data\git\myrepo\sand-report\data\obj\gh_to_houdini\ring2.obj")
path = FilePath("F:\odrive\Google Drive\JH\Projects\[051] GrasshopperHowtos\GH Files\GrasshopperHowtos\0127 GH to Houdini\geo\ring2.obj")
c_script = CSharpScript(file=path, import=Toggle(False), reset=Toggle(False))  # -> out, geometries; inputs file: String, import: Boolean, reset: Boolean
# ---------- c_script: C# usings ----------
using System.Linq;
using Rhino.DocObjects;
# ---------- c_script: C# ----------
    if(import){
      RhinoDoc.ActiveDoc.Objects.UnselectAll();
      string cmd = "!_-Import " + "\"" + file + "\"" + " _Enter";
      Rhino.RhinoApp.RunScript(cmd, false);
      var selectedObjs = RhinoDoc.ActiveDoc.Objects.GetSelectedObjects(false, false).ToList();
      geos = new List<GeometryBase>();
      foreach(RhinoObject selectedObj in selectedObjs){
        var geo = selectedObj.Geometry;
        geos.Add(geo);
        RhinoDoc.ActiveDoc.Objects.Delete(selectedObj, true);
      }
    }
    
    if(reset){
      geos.Clear();
    }
    

    geometries = geos;
# ---------- c_script: C# additional code ----------
  private List<GeometryBase> geos = new List<GeometryBase>();
# ---------- end c_script ----------
geo = Geometry(c_script.geometries)

move_2 = Move(Geometry=short_2.ListA, Motion=short_2.ListB)  # -> Geometry, Transform
move_3 = Move(Geometry=short.ListA, Motion=short.ListB)  # -> Geometry, Transform
offset = OffsetCurve(Curve=crv, Distance=expr("x", Slider(4, range=0..100)), Corners=1)
weave = Weave(Pattern=[0, 1], Stream0=short_2.ListA, Stream1=move_3.Geometry, NullGaps=False)
divide_2 = DivideCurve(Curve=offset, Count=number_slider, Kinks=False)  # -> Points, Tangents, Parameters
Z_4 = UnitZ(Factor=1)
line = LineSDL(Start=weave, Direction=Z_4, Length=1)
ln = Line(StartPoint=divide_2.Points, EndPoint=weave)
rad = Radians(Degrees="30")
vec = Vector(ln)
vrot = Rotate(Vector=vec, Axis=divide_2.Tangents, Angle=rad)
line_2 = LineSDL(Start=divide_2.Points, Direction=vrot, Length=1)
llx = LineLine(Line1=line, Line2=line_2)  # -> ParamA, ParamB, PointA, PointB
pt = Point(weave)
pt_2 = Point(llx.PointA)

shatter = Shatter(Curve=crv, Parameters=divlength.Parameters)
dispatch_3 = Dispatch(List=shatter, DispatchPattern=[True, False])  # -> ListA, ListB
move_4 = Move(Geometry=dispatch_3.ListB, Motion=short_2.ListB)  # -> Geometry, Transform
move_5 = Move(Geometry=dispatch_3.ListA, Motion=short.ListB)  # -> Geometry, Transform
Z_5 = UnitZ(Factor=number_slider_2)
move_6 = Move(Geometry=move_5.Geometry, Motion=Z_5)  # -> Geometry, Transform
weave_2 = Weave(Pattern=[0, 1], Stream0=move_6.Geometry, Stream1=move_4.Geometry, NullGaps=False)
end = EndPoints(Curve=graft(weave_2))  # -> Start, End
merge_2 = Merge(Data1=end.Start, Data2=end.End)
pline = PolyLine(Vertices=flatten(merge_2), Closed=False)
Z_6 = UnitZ(Factor=1)
move_7 = Move(Geometry=pline, Motion=Z_6)  # -> Geometry, Transform
project = Project(Geometry=pline, Plane=PlaneXY(0, 0, 0))  # -> Geometry, Transform
merge_3 = Merge(Data1=move_7.Geometry, Data2=project.Geometry)
loft = Loft(Curves=merge_3, Options={Adjust=False, Closed=False, LoftEnds=0, LoftSimp=0, LoftType=0, Rebuild=10, Refit=0.01})

neg_4 = Negative()
neg_5 = Negative()

number_slider_3 = Slider(10, range=1..10)
pt_3 = Point(pt_2)
line_3 = LineSDL(Start=pt_3, Direction=expr("-x", divlength.Tangents), Length=number_slider_3)
line_4 = LineSDL(Start=pt_3, Direction=divlength.Tangents, Length=number_slider_3)
join_2 = JoinCurves(Curves=[line_4, line_3], Preserve=False)
end_2 = EndPoints(Curve=join_2)  # -> Start, End
merge_4 = Merge(Data1=graft(end_2.End), Data2=graft(end_2.Start))  # -> flatten(Result)
pline_2 = PolyLine(Vertices=merge_4, Closed=False)
crv_2 = Curve(pline_2)

nurbs = NurbsCurve(Vertices=pt, Degree=3, Periodic=False)  # -> Curve, Length, Domain
nurbs_2 = NurbsCurve(Vertices=pt_2, Degree=3, Periodic=False)  # -> Curve, Length, Domain
merge_5 = Merge(Data1=nurbs.Curve, Data2=nurbs_2.Curve)  # -> flatten(Result)
loft_2 = Loft(Curves=merge_5, Options={Adjust=False, Closed=False, LoftEnds=0, LoftSimp=0, LoftType=0, Rebuild=10, Refit=0.01})

pline_3 = PolyLine(Vertices=pt, Closed=False)
pline_4 = PolyLine(Vertices=pt_2, Closed=False)
merge_6 = Merge(Data1=pline_3, Data2=pline_4)  # -> flatten(Result)
loft_3 = Loft(Curves=merge_6, Options={Adjust=False, Closed=False, LoftEnds=0, LoftSimp=0, LoftType=0, Rebuild=10, Refit=0.01})

pt_4 = Point(pt)
line_5 = LineSDL(Start=pt_4, Direction=expr("-x", divlength.Tangents), Length=number_slider_3)
line_6 = LineSDL(Start=pt_4, Direction=divlength.Tangents, Length=number_slider_3)
join_3 = JoinCurves(Curves=[line_6, line_5], Preserve=False)
end_3 = EndPoints(Curve=join_3)  # -> Start, End
merge_7 = Merge(Data1=graft(end_3.End), Data2=graft(end_3.Start))  # -> flatten(Result)
pline_5 = PolyLine(Vertices=merge_7, Closed=False)
crv_3 = Curve(pline_5)
merge_8 = Merge(Data1=crv_2, Data2=crv_3)  # -> flatten(Result)
loft_4 = Loft(Curves=merge_8, Options={Adjust=False, Closed=False, LoftEnds=0, LoftSimp=0, LoftType=0, Rebuild=10, Refit=0.01})
geo_2 = Geometry(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)

geo_3 = Geometry(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)
geo_4 = Geometry(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)
geo_5 = Geometry(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)
geo_6 = Geometry(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)
geo_7 = Geometry(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)

geo_8 = Geometry(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)
geo_9 = Geometry(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)
geo_10 = Geometry(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)

geo_11 = Geometry(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)
geo_12 = Geometry(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)
geo_13 = Geometry(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)
geo_14 = Geometry(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)
geo_15 = Geometry(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)
geo_16 = Geometry(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)
geo_17 = Geometry(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)

merge_9 = Merge(
    Data1="arcs_multi_fin.iges",
    Data2=geo_11,
    Data3=geo_12,
    Data4=geo_13,
    Data5=geo_14,
    Data6=geo_15,
    Data7=geo_16,
    Data8=geo_17)

data = Data(merge_9)

# ----
# export iges
panel_2 = Panel("C:\Users\trtku\Data\git\myrepo\sand-report\data\iges\")
panel_3 = Panel("C:\Data\git\sand-report\data\iges\")
split = SplitList(List=data, Index=1)  # -> ListA, ListB
flatten = FlattenTree(Tree=split.ListB, Path="{0}")
path_2 = FilePath(panel_2)

# ----
# transform
# XpYpZp in Rhino
# XpZnYp in Houdi
X = UnitX(Factor=1)
line_7 = LineSDL(Start=Point(0, 0, 0), Direction=X, Length=1)
rotax = RotateAxis(Angle=-1.570796327, Axis=line_7)  # -> Geometry, Transform
transform = Transform(Geometry=flatten, Transform=rotax.Transform)

c_script_2 = CSharpScript(geometries=transform, filename=split.ListA, directory=path_2, export=Toggle(False))  # inputs geometries: tree of GeometryBase, filename: String, directory: String, export: Boolean
# ---------- c_script_2: C# usings ----------
using System.IO;
# ---------- c_script_2: C# ----------
    if(export){

      var guids = new List<Guid>();

      for(int i = 0; i < geometries.BranchCount; i++){
        for(int n = 0; n < geometries.Branches[i].Count; n++){
          var geom = geometries.Branches[i][n];
          var guid = Rhino.RhinoDoc.ActiveDoc.Objects.Add(geom);
          guids.Add(guid);
        }
      }

      Rhino.RhinoDoc.ActiveDoc.Objects.Select(guids);

      string filepath = Path.Combine(directory, filename);
      string cmd = "_-Export " + "\"" + filepath + "\"" + " _Enter _Enter";

      Rhino.RhinoApp.RunScript(cmd, false);

      Rhino.RhinoDoc.ActiveDoc.Objects.Delete(guids, true);
    }
# ---------- end c_script_2 ----------
