# Grasshopper definition camera_anim_presentation.gh (Grasshopper 1.0.7)
# plug-ins: InteracTool

# Think about good camera moves that you want to show during your presentation. You can select 3 different types:
# 
# 1. Tween between 2 viewports
# 2. Move along path
# 3. Turn your head around
py = GhPythonScript()  # -> path
# ---------- py: Python ----------
import os
import sys

filename = ghenv.Component.OnPingDocument().FilePath
path = os.path.dirname(filename)

sys.path.append(path)
# ---------- end py ----------

# ----
# Tween between 2 viewports
update = Button()
py_2 = GhPythonScript(update=update, name="Entrance")  # -> frame
# ---------- py_2: Python ----------
import Rhino
import scriptcontext
from helpers import frame_from_viewport
from helpers import viewport_by_name

scriptcontext.doc = Rhino.RhinoDoc.ActiveDoc
viewport = viewport_by_name(name, scriptcontext)
scriptcontext.doc = ghdoc

frame = frame_from_viewport(viewport)
# ---------- end py_2 ----------
py_3 = GhPythonScript(update=update, name="Middle")  # -> frame; same code as py_2
py_4 = GhPythonScript(num=Slider(100, range=0..1000))  # -> values
# ---------- py_4: Python ----------
values = [v/(num - 1) for v in range(int(num))]
# ---------- end py_4 ----------
graph = GraphMapper(py_4, x0=0, x1=1, y0=0, y1=1, container_name="Bezier", cpx=[0, 0.4803687632, 0.5024860501, 1], cpy=[0, 0, 1, 1])
py_5 = GhPythonScript(path=py, frameA=py_2, frameB=py_3, parameters=graph)  # -> frames; inputs parameters: list
# ---------- py_5: Python ----------
from compas.utilities import XFunc

frames = XFunc('helpers.interpolate_between_frames', basedir=path)(frameA, frameB, parameters)
# ---------- end py_5 ----------
animation = GhPythonScript(name="anim1", frames=py_5, duration_seconds=Slider(8, range=0..10))  # -> animation; inputs frames: list
# ---------- animation: Python ----------
from animation import TransformAnimation

animation = TransformAnimation(name, duration_seconds, frames)
# ---------- end animation ----------

update_2 = Button()
py_6 = GhPythonScript(update=update_2)  # -> namedview_names
# ---------- py_6: Python ----------
import Rhino
import scriptcontext

scriptcontext.doc = Rhino.RhinoDoc.ActiveDoc
namedview_names = [view.Name for view in scriptcontext.doc.NamedViews]
scriptcontext.doc = ghdoc
# ---------- end py_6 ----------
panel = Panel(py_6)

# ----
# Turn your head around
# Decide if you want to look around 360 degrees or less.
# Decide if you want to look additionally up or down while you move your head.
number_slider = Slider(0, range=0..100)
update_3 = Button()
py_7 = GhPythonScript(update=update_3, name="Middle")  # -> frame; same code as py_2
dom = ConstructDomain(DomainStart=number_slider, DomainEnd=Slider(360, range=0..1000))
py_8 = GhPythonScript(domain=dom, increment=Slider(1, range=0..1))  # -> numbers, numbers_01
# ---------- py_8: Python ----------
def map_range(value, from_min, from_max, to_min, to_max):
    from_range = from_max - from_min
    to_range = to_max - to_min
    value_scaled = (value - from_min) / float(from_range)
    return to_min + (value_scaled * to_range)

v = domain[0]
numbers = []
while v <= domain[1]:
    numbers.append(v)
    v += increment

numbers_01 = [map_range(v, domain[0], domain[1], 0, 1) for v in numbers]
# ---------- end py_8 ----------
graph_2 = GraphMapper(
    py_8.numbers_01,
    x0=0,
    x1=1,
    y0=0,
    y1=1,
    container_name="Gaussian",
    factor=0.2191524506,
    mean=0.49007985,
    sdev=0.1406970918)
multiplication = Multiplication(A=graph_2, B=Slider(24, range=-100..100))
python = GhPythonScript(frame=py_7, angle_x_deg=multiplication, angle_y_deg=py_8.numbers)  # -> flatten(frame)
# ---------- python: Python ----------
import math
from compas.geometry import Frame
from compas.geometry import Rotation

R0 = Rotation.from_frame(frame)
Rx = Rotation.from_axis_and_angle(frame.xaxis, math.radians(angle_x_deg))
Ry = Rotation.from_axis_and_angle(frame.yaxis, math.radians(angle_y_deg))

frame = Frame.from_rotation(Ry * Rx * R0, point=frame.point)
#frame = frame.transformed(Ry * Rx * R0)

print frame.yaxis
# ---------- end python ----------

# ----
# Move along path
# define path and resulution
number_slider_2 = Slider(100, range=0..100)
path = Curve(<curve referenced from the Rhino model>)
frames = CurveFrames(Curve=path, Count=number_slider_2)  # -> Frames, Parameters
Z = UnitZ(Factor=1)
py_9 = GhPythonScript(plane=frames.Frames, zaxis=Z)  # -> flatten(frame)
# ---------- py_9: Python ----------
import Rhino.Geometry as rg
from compas.geometry import Frame
yaxis = rg.Vector3d.CrossProduct(rg.Vector3d.ZAxis, rg.Vector3d.XAxis)

yaxis = rg.Vector3d.CrossProduct(zaxis, plane.XAxis)

frame = Frame(plane.Origin, -yaxis, zaxis)
# ---------- end py_9 ----------
animation_2 = GhPythonScript(name="anim4", frames=py_9, duration_seconds=Slider(9, range=0..10))  # -> animation; inputs frames: list; same code as animation

# ----
# Tween between 2 viewports
panel_2 = Panel("Fin")
update_4 = Button()
py_10 = GhPythonScript(update=update_4, name=panel_2)  # -> frame; same code as py_2
py_11 = GhPythonScript(list=py_9)  # -> last_item; inputs list: list
# ---------- py_11: Python ----------
last_item = list[-1]
# ---------- end py_11 ----------
py_12 = GhPythonScript(num=Slider(100, range=0..1000))  # -> values; same code as py_4
graph_3 = GraphMapper(py_12, x0=0, x1=1, y0=0, y1=1, container_name="Bezier", cpx=[0, 0.4803687632, 0.5024860501, 1], cpy=[0, 0, 1, 1])
py_13 = GhPythonScript(path=py, frameA=py_11, frameB=py_10, parameters=graph_3)  # -> frames; inputs parameters: list; same code as py_5
animation_3 = GhPythonScript(name="anim5", frames=py_13, duration_seconds=Slider(9, range=0..10))  # -> animation; inputs frames: list; same code as animation

# ----
# Move along path
# define path and resulution
number_slider_3 = Slider(100, range=0..100)
path_2 = Curve(<curve referenced from the Rhino model>)
frames_2 = CurveFrames(Curve=path_2, Count=number_slider_3)  # -> Frames, Parameters
Z_2 = UnitZ(Factor=1)
py_14 = GhPythonScript(plane=frames_2.Frames, zaxis=Z_2)  # -> flatten(frame); same code as py_9
animation_4 = GhPythonScript(name="anim2", frames=py_14, duration_seconds=Slider(9, range=0..10))  # -> animation; inputs frames: list; same code as animation

python_2 = GhPythonScript(x=Button())  # -> out, a
# ---------- python_2: Python ----------
from compas_rhino import unload_modules

unload_modules("helpers")
unload_modules("compas_fab")
# ---------- end python_2 ----------

# ----
# Set unique name and duration of the animation
number_slider_4 = Slider(19, range=0..20)
animation_5 = GhPythonScript(name="anim3", frames=python, duration_seconds=number_slider_4)  # -> animation; inputs frames: list; same code as animation

entwine = Entwine(
    Branch00=animation,
    Branch01=animation_4,
    Branch02=animation_5,
    Branch03=animation_2,
    Branch04=animation_3,
    FlattenInputs=True)
animations = Data(flatten(entwine))
write = GhPythonScript(path=py, filename="animations.json", animations=animations)  # inputs animations: list
# ---------- write: Python ----------
import os
import json

filepath = os.path.join(path, filename)

data = [a.data for a in animations]

with open(filepath, 'w+') as f:
    json.dump(data, f)
# ---------- end write ----------
panel_3 = Panel("hide layers")

toggle = BooleanToggle(False)
# Select one of those keys to start the respective animation
timer = Timer(Interval=5, TimerInterval=5, Target=keyboard)  # disabled
keyboard = KeyBoardEvent(Start=toggle, Keys="a")  # -> Current, Pressed, Toggled
keyboard_2 = KeyBoardEvent(Start=toggle, Keys="s")  # -> Current, Pressed, Toggled
keyboard_3 = KeyBoardEvent(Start=toggle, Keys="d")  # -> Current, Pressed, Toggled
keyboard_4 = KeyBoardEvent(Start=toggle, Keys="f")  # -> Current, Pressed, Toggled
keyboard_5 = KeyBoardEvent(Start=toggle, Keys="g")  # -> Current, Pressed, Toggled

py_15 = GhPythonScript()  # -> layer_state_names
# ---------- py_15: Python ----------
import Rhino
import scriptcontext
import Rhino.Geometry as rg
import rhinoscriptsyntax as rs

scriptcontext.doc = Rhino.RhinoDoc.ActiveDoc
plugin = rs.GetPlugInObject("Rhino Bonus Tools")
layer_state_names = plugin.LayerStateNames()
scriptcontext.doc = ghdoc
# ---------- end py_15 ----------

keyboard_6 = KeyBoardEvent(Start=Toggle(True), Keys="a")  # -> Current, Pressed, Toggled

keyboard_7 = KeyBoardEvent(Start=Toggle(True), Keys="s")  # -> Current, Pressed, Toggled

py_16 = GhPythonScript()  # -> layer_names
# ---------- py_16: Python ----------
import Rhino
import scriptcontext
import Rhino.Geometry as rg
import rhinoscriptsyntax as rs

scriptcontext.doc = Rhino.RhinoDoc.ActiveDoc
layer_names = rs.LayerNames()
scriptcontext.doc = ghdoc
# ---------- end py_16 ----------
panel_4 = Panel(py_16)
panel_5 = Panel(py_15)
pressed = Data([keyboard.Pressed, keyboard_2.Pressed, keyboard_3.Pressed, keyboard_4.Pressed, keyboard_5.Pressed])
keys = Data(["a", "s", "d", "f", "g"])
panel_6 = Panel(keyboard.Pressed)
python_3 = GhPythonScript(keys=keys, pressed=pressed, animations=animations)  # -> out, selected_key, start, frames; inputs keys: list, pressed: list, animations: list
# ---------- python_3: Python ----------
from scriptcontext import sticky as st

guid = str(ghenv.Component.InstanceGuid)
anim = "anim" + guid

selected_key = None
selected_animation = None

for i, (k, p) in enumerate(zip(keys, pressed)):
    if p == True:
        selected_key = k
        st[anim] = animations[i]
        break

start = False
if selected_key != None:
    print selected_key
    start = True

if anim in st:
    frames = st[anim].frames
# ---------- end python_3 ----------
python_4 = GhPythonScript(name="Layer 01", pressed=keyboard_6.Pressed)  # -> out, a
# ---------- python_4: Python ----------
import Rhino
import scriptcontext
import Rhino.Geometry as rg
import rhinoscriptsyntax as rs

if pressed:
    scriptcontext.doc = Rhino.RhinoDoc.ActiveDoc
    rs.LayerVisible("Layer 01", visible=(not rs.IsLayerVisible(name)))
    scriptcontext.doc = ghdoc
# ---------- end python_4 ----------
python_5 = GhPythonScript(name="TestLayerState", pressed=keyboard_7.Pressed)  # -> out, a
# ---------- python_5: Python ----------
import Rhino
import scriptcontext
import Rhino.Geometry as rg
import rhinoscriptsyntax as rs

if pressed:
    scriptcontext.doc = Rhino.RhinoDoc.ActiveDoc
    plugin = rs.GetPlugInObject("Rhino Bonus Tools")
    plugin.RestoreLayerState(name)
    scriptcontext.doc = ghdoc
# ---------- end python_5 ----------
panel_7 = Panel(python_3.selected_key)
counter = GhPythonScript(list=python_3.frames, start=python_3.start, loop=Toggle(False))  # -> item; inputs list: list
# ---------- counter: Python ----------
from scriptcontext import sticky as st

guid = str(ghenv.Component.InstanceGuid)
counter_key = "counter" + guid

start_value, stop_value = 0, len(list) - 1
running_key = "running" + guid

if counter_key not in st or reset:
    st[counter_key] = start_value
    st[running_key] = False

if start: 
    st[running_key] = True
    st[counter_key] = start_value

item = list[st[counter_key]]

if st[running_key]:
    if st[counter_key] < stop_value:
        st[counter_key] += 1
    else:
        #st[counter_key] = start_value
        if not loop:
            st[running_key] = False
# ---------- end counter ----------
# Select one of the NamedCamera views as active
update_5 = Button()
py_17 = GhPythonScript(update=update_5)  # -> active_viewport
# ---------- py_17: Python ----------
import Rhino
import scriptcontext
import Rhino.Geometry as rg

scriptcontext.doc = Rhino.RhinoDoc.ActiveDoc
active_viewport = scriptcontext.doc.Views.ActiveView.ActiveViewport
#print scriptcontext.doc.Views.ActiveView.ActiveViewport.Name
scriptcontext.doc = ghdoc
# ---------- end py_17 ----------
camera = GhPythonScript(active_viewport=py_17, frame=counter)
# ---------- camera: Python ----------
import Rhino
import scriptcontext
import Rhino.Geometry as rg
from compas.geometry import Vector, Frame

if frame:
    location = rg.Point3d(*list(frame.point))
    direction = rg.Vector3d(*list(frame.zaxis))
    up = rg.Vector3d(*list(frame.yaxis))
    
    active_viewport.SetCameraDirection(-direction, True)
    active_viewport.SetCameraLocation(location, True)
    
    print active_viewport.FrustumAspect
    print active_viewport.Bounds
    print active_viewport.Camera35mmLensLength
# ---------- end camera ----------
write_2 = GhPythonScript(path=py, filename="camera.json", viewport=py_17)
# ---------- write_2: Python ----------
import os
import json

camera_data = {"focal_length" : viewport.Camera35mmLensLength} 

filepath = os.path.join(path, filename)

with open(filepath, 'w+') as f:
    json.dump(camera_data, f)
# ---------- end write_2 ----------
