# Grasshopper definition formwork_spiral_v1.ghx (Grasshopper 1.0.7)

multiplication = Multiplication(A="50", B=2)
cir = Circle(Plane=PlaneXY(0, 0, 0), Radius="50")
Z = UnitZ(Factor=multiplication)
scale = Scale(Geometry=cir, Center=Point(0, 0, 0), Factor=Slider(1.06, range=0..1.06))  # -> Geometry, Transform
move = Move(Geometry=scale.Geometry, Motion=Z)  # -> Geometry, Transform
offset = OffsetCurve(Curve=move.Geometry, Distance="3", Corners=1)
offset_2 = OffsetCurve(Curve=cir, Distance="3", Corners=1)
offset_3 = OffsetCurve(Curve=offset_2, Distance="3", Corners=1)
rotate = Rotate(Geometry=cir, Angle=0.3141592654, Plane=PlaneXY(0, 0, 0))  # -> Geometry, Transform
divide = DivideCurve(Curve=reparameterize(rotate.Geometry), Count="16", Kinks=False)  # -> Points, Tangents, Parameters
rotate_2 = Rotate(Geometry=offset, Angle=0.3141592654, Plane=PlaneXY(0, 0, 0))  # -> Geometry, Transform
divide_2 = DivideCurve(Curve=reparameterize(rotate_2.Geometry), Count="16", Kinks=False)  # -> Points, Tangents, Parameters
merge = Merge(Data1=cir, Data2=offset_2)  # -> flatten(Result)
merge_2 = Merge(Data1=offset_2, Data2=offset_3)  # -> flatten(Result)
merge_3 = Merge(Data1=move.Geometry, Data2=offset)  # -> flatten(Result)
eval = EvaluateCurve(Curve=reparameterize(rotate.Geometry), Parameter=divide.Parameters)  # -> Point, Tangent, Angle
eval_2 = EvaluateCurve(Curve=reparameterize(rotate_2.Geometry), Parameter=divide_2.Parameters)  # -> Point, Tangent, Angle
boundary = BoundarySurfaces(Edges=merge_2)
boundary_2 = BoundarySurfaces(Edges=merge)
Z_2 = UnitZ(Factor="10")
Z_3 = UnitZ(Factor="3")
Z_4 = UnitZ(Factor=multiplication)
boundary_3 = BoundarySurfaces(Edges=merge_3)
Z_5 = UnitZ(Factor=1)
Z_6 = UnitZ(Factor=1)
number_slider = Slider(10, range=0..10)
number_slider_2 = Slider(10, range=0..10)
extr = Extrude(Base=boundary_3, Direction=expr("-x", Z_2))
extr_2 = Extrude(Base=boundary, Direction=Z_3)
extr_3 = Extrude(Base=boundary_2, Direction=Z_2)
extr_4 = Extrude(Base=boundary_2, Direction=Z_4)
xprod = CrossProduct(VectorA=eval.Tangent, VectorB=Z_5, Unitize=False)  # -> Vector, Length
xprod_2 = CrossProduct(VectorA=eval_2.Tangent, VectorB=Z_6, Unitize=False)  # -> Vector, Length
vdis = VectorDisplay(Anchor=eval.Point, Vector=xprod.Vector)
vdis_2 = VectorDisplay(Anchor=eval_2.Point, Vector=xprod_2.Vector)
pl = ConstructPlane(Origin=eval.Point, XAxis=xprod.Vector, YAxis=Vector(0, 1, 0))
pl_2 = ConstructPlane(Origin=eval_2.Point, XAxis=xprod_2.Vector, YAxis=Vector(0, 1, 0))
box = DomainBox(Base=PlaneXY(0, 0, 0), X=Domain(-75, 75), Y=Domain(-75, 75), Z=Domain(0, 4))
Z_7 = UnitZ(Factor="3")
subtraction = Subtraction(A=number_slider, B=1)
subtraction_2 = Subtraction(A=number_slider_2, B=1)
division = Division(A="360", B="16")
subtraction_3 = Subtraction(A=multiplication, B="3")
subtraction_4 = Subtraction(A=subtraction_3, B=4)
move_2 = Move(Geometry=box, Motion=Z_7)  # -> Geometry, Transform
rectangle = Rectangle(Plane=pl_2, XSize=Domain(-2, 5), YSize=Domain(-5, 5), Radius=0)  # -> Rectangle, Length
Z_8 = UnitZ(Factor="3")
division_2 = Division(A=multiplication, B=subtraction)
division_3 = Division(A=division, B=subtraction_2)
rectangle_2 = Rectangle(Plane=pl, XSize=Domain(-7, 10), YSize=Domain(-5, 5), Radius=0)  # -> graft(Rectangle), Length
Z_9 = UnitZ(Factor=subtraction_4)
series = Series(Start=0, Step=division_2, Count=number_slider)
series_2 = Series(Start=0, Step=division_3, Count=number_slider_2)
extr_5 = Extrude(Base=rectangle.Rectangle, Direction=expr("-x", Z_8))
merge_4 = Merge(Data1=cir, Data2=move.Geometry)
Z_10 = UnitZ(Factor=series)
rad = Radians(Degrees=series_2)
cap = CapHoles(Brep=extr_5)
loft = Loft(Curves=merge_4, Options={Adjust=False, Closed=False, LoftEnds=0, LoftSimp=0, LoftType=0, Rebuild=10, Refit=0.01})
debrep = DeconstructBrep(Brep=loft)  # -> Faces, Edges, Vertices
item = ListItem(List=debrep.Edges, Index=0, Wrap=True)  # -> Item, Item1, Item2
move_3 = Move(Geometry=rectangle_2.Rectangle, Motion=Z_10)  # -> Geometry, Transform
offset_4 = OffsetSurface(Surface=loft, Distance=-3, Retrim=True)
debrep_2 = DeconstructBrep(Brep=offset_4)  # -> Faces, Edges, Vertices
item_2 = ListItem(List=debrep_2.Edges, Index=0, Wrap=True)  # -> Item, Item1, Item2
rotate_3 = Rotate(Geometry=move_3.Geometry, Angle=rad, Plane=PlaneXY(0, 0, 0))  # -> Geometry, Transform
loft_2 = Loft(
    Curves=[item.Item2, item_2.Item2],
    Options={Adjust=False, Closed=False, LoftEnds=0, LoftSimp=0, LoftType=0, Rebuild=10, Refit=0.01})
loft_3 = Loft(
    Curves=[item.Item1, item_2.Item1],
    Options={Adjust=False, Closed=False, LoftEnds=0, LoftSimp=0, LoftType=0, Rebuild=10, Refit=0.01})
loft_4 = Loft(
    Curves=rotate_3.Geometry,
    Options={Adjust=False, Closed=False, LoftEnds=0, LoftSimp=0, LoftType=0, Rebuild=10, Refit=0.01})
merge_5 = Merge(Data1=loft, Data2=loft_3, Data3=offset_4, Data4=loft_2)  # -> flatten(Result)
cap_2 = CapHoles(Brep=loft_4)
join = BrepJoin(Breps=merge_5)  # -> Breps, Closed
sdiff = SolidDifference(BrepsA=move_2.Geometry, BrepsB=join.Breps)
item_3 = ListItem(List=sdiff, Index=0, Wrap=True)
debrep_3 = DeconstructBrep(Brep=item_3)  # -> Faces, Edges, Vertices
move_4 = Move(Geometry=item_3, Motion=Z_9)  # -> Geometry, Transform
debrep_4 = DeconstructBrep(Brep=move_4.Geometry)  # -> Faces, Edges, Vertices
item_4 = ListItem(List=debrep_3.Edges, Index=0, Wrap=True)  # -> Item, Item1, Item2, Item3, Item4, Item5, Item6, Item7
item_5 = ListItem(List=debrep_4.Edges, Index=0, Wrap=True)  # -> Item, Item1, Item2, Item3
merge_6 = Merge(Data1=item_4.Item4, Data2=item_5.Item)
merge_7 = Merge(Data1=item_4.Item5, Data2=item_5.Item1)
merge_8 = Merge(Data1=item_4.Item6, Data2=item_5.Item2)
merge_9 = Merge(Data1=item_4.Item7, Data2=item_5.Item3)
loft_5 = Loft(Curves=merge_6, Options={Adjust=True, Closed=False, LoftEnds=0, LoftSimp=0, LoftType=0, Rebuild=10, Refit=0.01})
loft_6 = Loft(Curves=merge_7, Options={Adjust=True, Closed=False, LoftEnds=0, LoftSimp=0, LoftType=0, Rebuild=10, Refit=0.01})
loft_7 = Loft(Curves=merge_8, Options={Adjust=True, Closed=False, LoftEnds=0, LoftSimp=0, LoftType=0, Rebuild=10, Refit=0.01})
loft_8 = Loft(Curves=merge_9, Options={Adjust=True, Closed=False, LoftEnds=0, LoftSimp=0, LoftType=0, Rebuild=10, Refit=0.01})
flatten = FlattenTree(Tree=cap_2, Path="{0}")
X = UnitX(Factor="4")
Y = UnitY(Factor="4")
sdiff_2 = SolidDifference(BrepsA=join.Breps, BrepsB=flatten)
extr_6 = Extrude(Base=loft_7, Direction=expr("-x", Y))
extr_7 = Extrude(Base=loft_6, Direction=expr("-x", X))
extr_8 = Extrude(Base=loft_5, Direction=Y)
extr_9 = Extrude(Base=loft_8, Direction=X)
brep = Brep(sdiff_2)
merge_10 = Merge(Data1=extr_7, Data2=extr_9)  # -> flatten(Result)
merge_11 = Merge(Data1=extr_7, Data2=extr_9)  # -> flatten(Result)
sdiff_3 = SolidDifference(BrepsA=extr_6, BrepsB=merge_10)
sdiff_4 = SolidDifference(BrepsA=extr_8, BrepsB=merge_11)
merge_12 = Merge(Data1=extr, Data2=brep, Data3=extr_3, Data4=extr_2)
sunion = SolidUnion(Breps=merge_12)
