# Grasshopper definition model_at_topic_proposal-vault.ghx (Grasshopper 1.0.7)

mesh = Mesh(<mesh referenced from the Rhino model>)
mesh_2 = Mesh(<mesh referenced from the Rhino model>)
medges = MeshEdges(Mesh=mesh_2)  # -> NakedEdges, InteriorEdges, NonManifoldEdges
medges_2 = MeshEdges(Mesh=mesh)  # -> NakedEdges, InteriorEdges, NonManifoldEdges
line = Line(medges.NakedEdges)
line_2 = Line(medges_2.NakedEdges)
merge = Merge(Data1=simplify(graft(line)), Data2=simplify(graft(line_2)))
loft = Loft(Curves=merge, Options={Adjust=False, Closed=False, LoftEnds=0, LoftSimp=0, LoftType=0, Rebuild=10, Refit=0.01})
mesh_uv = MeshSurface(Surface=loft, UCount=1, VCount=1, Overhang=True, Equalize=False)
tri = Triangulate(Mesh=mesh_uv)  # -> Mesh, Count
clean = CleanTree(RemoveNulls=True, RemoveInvalid=True, RemoveEmpty=True, Tree=tri.Mesh)
panel = Panel(clean)
mjoin = MeshJoin(Meshes=flatten(clean))
merge_2 = Merge(Data1=mesh_2, Data2=mjoin, Data3=mesh)
mjoin_2 = MeshJoin(Meshes=flatten(merge_2))
