# Grasshopper definition model_at_topic_proposal.ghx (Grasshopper 1.0.7)

pt = Point(Point(286.1014706, 152.4338438, 0))
pt_2 = Point(Point(236.8650978, 45.98439261, 0))
pt_3 = Point(Point(166.4059556, 100.8028446, 0))
pt_4 = Point(Point(90.57089404, 91.24045827, 0))
pt_5 = Point(Point(210.5016927, 229.9213016, 0))
pt_6 = Point(Point(66.13122737, 229.1924032, 0))
pt_7 = Point(Point(118.0691377, 300.0732025, 0))
cir = Circle(Plane=pt_2, Radius=Slider(20, range=0..50))
cir_2 = Circle(Plane=pt_3, Radius=Slider(30, range=0..50))
cir_3 = Circle(Plane=pt_4, Radius=Slider(40, range=0..50))
cir_4 = Circle(Plane=pt_5, Radius=Slider(50, range=0..50))
cir_5 = Circle(Plane=pt_6, Radius=Slider(40, range=0..50))
cir_6 = Circle(Plane=pt_7, Radius=Slider(40, range=0..50))
cir_7 = Circle(Plane=pt, Radius=Slider(20, range=0..50))
tanin = TangentLinesIn(CircleA=cir_3, CircleB=cir_4)  # -> Tangent1, Tangent2
tanin_2 = TangentLinesIn(CircleA=cir_2, CircleB=cir_3)  # -> Tangent1, Tangent2
tanin_3 = TangentLinesIn(CircleA=cir_4, CircleB=cir_5)  # -> Tangent1, Tangent2
tanin_4 = TangentLinesIn(CircleA=cir_5, CircleB=cir_6)  # -> Tangent1, Tangent2
tanin_5 = TangentLinesIn(CircleA=cir, CircleB=cir_2)  # -> Tangent1, Tangent2
tanin_6 = TangentLinesIn(CircleA=cir_7, CircleB=cir)  # -> Tangent1, Tangent2
line = Line(tanin_5.Tangent1)
line_2 = Line(tanin_2.Tangent2)
line_3 = Line(tanin.Tangent1)
line_4 = Line(tanin_3.Tangent2)
line_5 = Line(tanin_4.Tangent1)
line_6 = Line(tanin_6.Tangent2)
ccx = CurveCurve(CurveA=cir, CurveB=line_6)  # -> Points, ParamsA, ParamsB
ccx_2 = CurveCurve(CurveA=cir, CurveB=line)  # -> Points, ParamsA, ParamsB
ccx_3 = CurveCurve(CurveA=cir_5, CurveB=line_4)  # -> Points, ParamsA, ParamsB
ccx_4 = CurveCurve(CurveA=cir_2, CurveB=line)  # -> Points, ParamsA, ParamsB
ccx_5 = CurveCurve(CurveA=cir_2, CurveB=line_2)  # -> Points, ParamsA, ParamsB
ccx_6 = CurveCurve(CurveA=cir_3, CurveB=line_2)  # -> Points, ParamsA, ParamsB
ccx_7 = CurveCurve(CurveA=cir_3, CurveB=line_3)  # -> Points, ParamsA, ParamsB
ccx_8 = CurveCurve(CurveA=cir_4, CurveB=line_3)  # -> Points, ParamsA, ParamsB
ccx_9 = CurveCurve(CurveA=cir_4, CurveB=line_4)  # -> Points, ParamsA, ParamsB
ccx_10 = CurveCurve(CurveA=cir_5, CurveB=line_5)  # -> Points, ParamsA, ParamsB
merge = Merge(Data1=ccx_6.ParamsA, Data2=ccx_7.ParamsA)
merge_2 = Merge(Data1=ccx_3.ParamsA, Data2=ccx_10.ParamsA)
merge_3 = Merge(Data1=ccx_4.ParamsA, Data2=ccx_5.ParamsA)
merge_4 = Merge(Data1=ccx_8.ParamsA, Data2=ccx_9.ParamsA)
merge_5 = Merge(Data1=ccx.ParamsA, Data2=ccx_2.ParamsA)
shatter = Shatter(Curve=cir_3, Parameters=merge)
shatter_2 = Shatter(Curve=cir_5, Parameters=merge_2)
shatter_3 = Shatter(Curve=cir_2, Parameters=merge_3)
shatter_4 = Shatter(Curve=cir_4, Parameters=merge_4)
shatter_5 = Shatter(Curve=cir, Parameters=merge_5)
item = ListItem(List=shatter, Index=0, Wrap=True)
item_2 = ListItem(List=shatter_2, Index=0, Wrap=True)
item_3 = ListItem(List=shatter_3, Index=0, Wrap=True)
item_4 = ListItem(List=shatter_4, Index=0, Wrap=True)  # -> Item, Item1
item_5 = ListItem(List=shatter_5, Index=0, Wrap=True)
crv = Curve(item_2)
crv_2 = Curve(item)
crv_3 = Curve(item_3)
crv_4 = Curve(item_4.Item1)
crv_5 = Curve(item_5)
merge_6 = Merge(
    Data1=line_6,
    Data2=crv_5,
    Data3=line,
    Data4=crv_3,
    Data5=line_2,
    Data6=crv_2,
    Data7=line_3,
    Data8=crv_4,
    Data9=line_4,
    Data10=crv,
    Data11=line_5)
join = JoinCurves(Curves=flatten(merge_6), Preserve=False)
offset = OffsetCurve(Curve=join, Distance=Slider(20, range=0..20), Corners=1)
end = EndPoints(Curve=join)  # -> Start, End
end_2 = EndPoints(Curve=offset)  # -> Start, End
ln = Line(StartPoint=end.Start, EndPoint=end_2.Start)
ln_2 = Line(StartPoint=end.End, EndPoint=end_2.End)
Z = UnitZ(Factor=Slider(120, range=0..1000))
merge_7 = Merge(Data1=join, Data2=ln, Data3=offset, Data4=ln_2)  # -> flatten(Result)
extr = Extrude(Base=merge_7, Direction=Z)
join_2 = JoinCurves(Curves=merge_7, Preserve=False)
Z_2 = UnitZ(Factor=Slider(120, range=0..1000))
extr_2 = Extrude(Base=join_2, Direction=Z_2)
boundary = BoundarySurfaces(Edges=join_2)
merge_8 = Merge(Data1=boundary, Data2=extr_2)  # -> flatten(Result)
join_3 = BrepJoin(Breps=merge_8)  # -> Breps, Closed
