# Grasshopper definition pavilion.ghx (Grasshopper 1.0.7)

number_slider = Slider(2000, range=0..10000)
xy = XYPlane(Origin=Point(0, 0, 0))
number_slider_2 = Slider(8, range=0..10)
rectangle = Rectangle(Plane=xy, XSize=number_slider, YSize=number_slider, Radius=0)  # -> Rectangle, Length
offset = OffsetCurve(Curve=rectangle.Rectangle, Distance=expr("-x", Slider(300, range=0..1000)), Corners=1)
pop2d = Populate2D(Region=offset, Count=number_slider_2, Seed=Slider(7, range=1..10))
voronoi = Voronoi(Points=pop2d, Boundary=rectangle.Rectangle, Plane=xy, BruteForceOverride=False)
random = Random(Range=Domain(0, 1), Number=number_slider_2, Seed=2)
xy_2 = XYPlane(Origin=pop2d)
dom = ConstructDomain(DomainStart=Slider(2000, range=0..10000), DomainEnd=Slider(2000, range=0..10000))
remap = RemapNumbers(Value=random, Source=Domain(0, 1), Target=dom)  # -> Mapped, Clipped
Z = UnitZ(Factor=Slider(50, range=0..100))
offset_2 = OffsetCurve(Curve=voronoi, Distance=expr("-x", Slider(15, range=0..100)), Plane=xy_2, Corners=0)  # -> flatten(Curve)
area = Area(Geometry=offset_2)  # -> Area, Centroid
extr = Extrude(Base=offset_2, Direction=Z)
cap = CapHoles(Brep=extr)
Z_2 = UnitZ(Factor=remap.Mapped)
line = LineSDL(Start=area.Centroid, Direction=Vector(0, 0, 1), Length=remap.Mapped)
move = Move(Geometry=cap, Motion=Z_2)  # -> Geometry, Transform
volume = Volume(Geometry=move.Geometry)  # -> Volume, Centroid
pipe = Pipe(Curve=line, Radius=Slider(50, range=0..100), Caps=0)
