# Grasshopper definition pavilion_1to1.ghx (Grasshopper 1.0.7)
# plug-ins: Kangaroo2 Components, Weaverbird, NGon

xy = XYPlane(Origin=Point(0, 0, 0))
number_slider = Slider(1800, range=0..10000)
number_slider_2 = Slider(6, range=0..10)
rectangle = Rectangle(Plane=xy, XSize=number_slider, YSize=number_slider, Radius=0)  # -> Rectangle, Length
offset = OffsetCurve(Curve=rectangle.Rectangle, Distance=expr("-x", Slider(300, range=0..1000)), Corners=1)
pop2d = Populate2D(Region=offset, Count=number_slider_2, Seed=Slider(6, range=1..10))
voronoi = Voronoi(Points=pop2d, Boundary=rectangle.Rectangle, Plane=xy, BruteForceOverride=False)
xy_2 = XYPlane(Origin=pop2d)
mergin = Slider(30, range=0..100)
offset_2 = OffsetCurve(Curve=voronoi, Distance=expr("-x", mergin), Plane=xy_2, Corners=0)  # -> flatten(Curve)
random = Random(Range=Domain(0, 1), Number=number_slider_2, Seed=2)
dom = ConstructDomain(DomainStart=Slider(2000, range=0..10000), DomainEnd=Slider(2000, range=0..10000))
remap = RemapNumbers(Value=random, Source=Domain(0, 1), Target=dom)  # -> Mapped, Clipped
number_slider_3 = Slider(50, range=0..100)
number_slider_4 = Slider(100, range=0..1000)
area = Area(Geometry=offset_2)  # -> Area, Centroid
cir = Circle(Plane=area.Centroid, Radius=number_slider_3)
multiplication = Multiplication(A=number_slider_3, B=Slider(1.2, range=1..2))
division = Division(A=number_slider_4, B=Slider(3, range=0..10))
Z = UnitZ(Factor=Slider(50, range=0..100))
offset_3 = OffsetCurve(Curve=cir, Distance=multiplication, Corners=1)
Z_2 = UnitZ(Factor=division)
Z_3 = UnitZ(Factor=number_slider_4)
extr = Extrude(Base=offset_2, Direction=Z)
neg = Negative(Value=Z_2)
neg_2 = Negative(Value=Z_3)
cap = CapHoles(Brep=extr)
Z_4 = UnitZ(Factor=remap.Mapped)
move = Move(Geometry=cir, Motion=neg_2)  # -> Geometry, Transform
move_2 = Move(Geometry=offset_3, Motion=neg)  # -> Geometry, Transform
move_3 = Move(Geometry=cap, Motion=Z_4)  # -> Geometry, Transform
volume = Volume(Geometry=move_3.Geometry)  # -> Volume, Centroid
merge = Merge(Data1=simplify(graft(offset_2)), Data2=simplify(move_2.Geometry))
merge_2 = Merge(Data1=simplify(move_2.Geometry), Data2=simplify(graft(move.Geometry)))
loft_opt = LoftOptions(Closed=False, Adjust=True, Rebuild=0, Refit=0, Type=0)
loft = Loft(Curves=merge, Options=loft_opt)
loft_2 = Loft(Curves=merge_2, Options={Adjust=False, Closed=False, LoftEnds=0, LoftSimp=0, LoftType=0, Rebuild=10, Refit=0.01})
merge_3 = Merge(Data1=loft, Data2=loft_2)
join = BrepJoin(Breps=merge_3)  # -> Breps, Closed
mesh = MeshBrep(
    Brep=join.Breps,
    Settings={GridMaxCount=0, GridMinCount=16, JaggedSeams=False, MaxEdgeLength=0, MinEdgeLength=0.0001, MinTolerance=0, Refine=True, RefineAngle=0, RelativeTolerance=0.65, SimplePlanes=True, Tolerance=0})
triremesh = TriRemesh(Geometry=mesh, Iterations=25)  # -> Triangulation, Dual, Creases
nv = NakedVertices(Mesh=triremesh.Triangulation)  # -> ClothedIndex, NakedIndex, ClothedPts, NakedPts
medges = MeshEdges(Mesh=triremesh.Triangulation)  # -> NakedEdges, InteriorEdges, NonManifoldEdges
merge_4 = Merge(Data1=medges.NakedEdges, Data2=medges.InteriorEdges)
pt = Point(nv.NakedPts)
anchor = Anchor(Point=pt, Target=pt, Strength=Slider(100000, range=0..100000))
show = Show(G=triremesh.Triangulation)
length_line = LengthLine(Line=merge_4, Length=Slider(0, range=0..100), Strength=Slider(100, range=0..10000))
entwine = Entwine(Branch00=[anchor, length_line], Branch01=show, FlattenInputs=True)
solver = Solver(GoalObjects=entwine, Reset=Button(), Threshold=1e-15, Tolerance=0.0001, On=Toggle(False))  # -> I, V, O
branch = TreeBranch(Tree=simplify(solver.O), Path="{1}", MaintainPaths=True)
number_slider_5 = Slider(30, range=0..100)
wbnaked = WeaverbirdsNakedBoundary(MeshClosedPolylines=graft(branch))
subtraction = Subtraction(A=Slider(2000, range=0..10000), B=number_slider_4)
offsetmesh = OffsetMesh(Mesh=branch, Dist=number_slider_5, Solid=True)
item = ListItem(List=wbnaked, Index=0, Wrap=True)  # -> Item, Item1
Z_5 = UnitZ(Factor=subtraction)
tri = Triangulate(Mesh=offsetmesh)  # -> Mesh, Count
neg_3 = Negative(Value=Z_5)
extr_2 = Extrude(Base=item.Item1, Direction=neg_3)
number_slider_6 = Slider(30, range=0..100)
mesh_2 = MeshBrep(
    Brep=extr_2,
    Settings={GridMaxCount=0, GridMinCount=16, JaggedSeams=False, MaxEdgeLength=0, MinEdgeLength=0.0001, MinTolerance=0, Refine=True, RefineAngle=0, RelativeTolerance=0.65, SimplePlanes=True, Tolerance=0})
m_caps = MeshCaps(M=mesh_2, W=True, O=True, D=0)  # -> out, A, E; inputs M: Mesh, clr: Color
# ---------- m_caps: VB ----------
    Component.Params.Input(0).Name = "Mesh"
    Component.Params.Input(0).Description = "An open mesh"
    Component.Params.Input(1).Name = "Join and Weld"
    Component.Params.Input(1).Description = "If true the original mesh will be joined and welded to the new caps, else the caps will be output as a list of new meshes"
    Component.Params.Input(2).Name = "Simplify Faces"
    Component.Params.Input(2).Description = "If true, naked edges consisting of 3 to 4 segments will be replaced with a single face, else faces will use new center vertex method"
    Component.Params.Input(3).Name = "Distance (Optional, Rhino Units)"
    Component.Params.Input(3).Description = "A single number which sets the Rhino unit based distance that the center point will be offset from the vertex averages"

    Component.Params.Output(1).Name = "Mesh"
    Component.Params.Output(1).Description = "If successful, a list or single of valid meshes"
    Component.Params.Output(2).Name = "Polylines"
    Component.Params.Output(2).Description = "If successful, a list of valid edge polylines"

    If M IsNot Nothing Then
      Dim i,j,k,kk,ka As Integer
      Dim arrP() As polyline
      Dim P As polyline
      Dim arrM As New list(Of Mesh)
      Dim mj As New mesh
      Dim clrB,clrC,blnN() As Boolean
      Dim oc,tcc As New list(Of color)
      If (clr <> Nothing) Then clrC = True
      If ((m.VertexColors.count() > 0) Or (clr <> Nothing)) Then clrB = True
      If (m.VertexColors.count() = 0) Then  m.vertexcolors.CreateMonotoneMesh(color.LightGray)
      oc = m.VertexColors.ToArray.tolist()
      Dim mv() As point3d
      Dim mo As New list(Of mesh)
      Dim fc As New list(Of MeshFace)
      Dim np As New list(Of point3d)
      Dim ni As New list(Of Integer)
      Dim ind(3) As Integer

      mv = m.Vertices.ToPoint3dArray()
      blnN = m.GetNakedEdgePointStatus()
      arrP = m.GetNakedEdges()

      For i = 0 To ubound(blnN) Step 1
        If blnN(i) Then
          np.add(mv(i))
          ni.add(i)
        End If
      Next

      Dim cld As New pointcloud(np.toarray())
      For i = 0 To ubound(arrP) Step 1
        Dim tm As New mesh
        tm.Vertices.Clear()
        tm.Faces.Clear()

        p = arrP(i)
        If (O And (p.count() < 6)) Then
          ind(0) = ni(cld.ClosestPoint(p(0)))
          ind(1) = ni(cld.ClosestPoint(p(1)))
          ind(2) = ni(cld.ClosestPoint(p(2)))
          ind(3) = ni(cld.ClosestPoint(p(3)))
          tm.Vertices.Add(mv(ind(0)))
          tm.Vertices.Add(mv(ind(1)))
          tm.Vertices.Add(mv(ind(2)))

          tm.VertexColors.Add(oc(ind(0)))
          tm.VertexColors.Add(oc(ind(1)))
          tm.VertexColors.Add(oc(ind(2)))
          If p.count() = 5 Then
            fc.add(New meshface(ind(0), ind(1), ind(2), ind(3)))
            tm.Vertices.Add(mv(ind(3)))
            tm.VertexColors.Add(oc(ind(3)))
            tm.Faces.addface(New meshface(0, 1, 2, 3))
          ElseIf p.count() = 4 Then
            fc.add(New meshface(ind(0), ind(1), ind(2)))
            tm.Faces.addface(New meshface(0, 1, 2))
          End If
          tm.FaceNormals.ComputeFaceNormals()
          tm.Normals.ComputeNormals()
          mo.add(tm)

        Else
          Dim tx As New mesh
          Dim vec As New vector3d
          Dim tv As New list(Of point3d)
          Dim tc As New list(Of color)
          Dim tfc As New list(Of meshface)
          Dim r,g,b As Integer
          Dim tcl As color
          k = cld.ClosestPoint(p(0))
          ka = k
          tx.Vertices.AddVertices(p.ToArray())
          tx.Faces.AddFaces(p.TriangulateClosedPolyline())
          tx.Normals.ComputeNormals()

          vec = tx.Normals(0)

          tv.add(p(0))
          tc.add(oc(k))
          r = oc(ni(k)).R
          g = oc(ni(k)).G
          b = oc(ni(k)).B
          For j = 1 To p.count() - 2 Step 1
            kk = cld.ClosestPoint(p(j))
            fc.add(New meshface(m.Vertices.count(), ni(k), ni(kk)))
            vec += tx.Normals(j)
            k = kk

            tv.add(p(j))
            tc.add(oc(k))
            r += oc(ni(k)).R
            g += oc(ni(k)).G
            b += oc(ni(k)).B
            tfc.add(New meshface(p.count() - 1, j - 1, j))
          Next
          fc.add(New meshface(m.Vertices.count(), ni(k), ni(ka)))
          vec.Unitize()
          vec *= D
          m.Vertices.add(p.CenterPoint() + vec)

          r /= (p.count() - 1)
          g /= (p.count() - 1)
          b /= (p.count() - 1)
          If r > 255 Then r = 255 Else If r < 0 Then r = 0
          If g > 255 Then g = 255 Else If g < 0 Then g = 0
          If b > 255 Then b = 255 Else If b < 0 Then b = 0
          If clrC Then tcl = clr Else tcl = color.FromArgb(r, g, b)
          m.VertexColors.Add(tcl)

          tv.add(p.CenterPoint() + vec)
          tc.add(tcl)
          tfc.add(New meshface(p.count() - 1, p.count() - 2, 0))
          tm.vertices.AddVertices(tv.toarray())
          If clrB Then tm.VertexColors.AppendColors(tc.toarray())
          tm.faces.addfaces(tfc)
          tm.FaceNormals.ComputeFaceNormals()
          tm.Normals.ComputeNormals()
          mo.add(tm)
        End If
      Next

      If w Then
        m.Faces.AddFaces(fc)
        m.FaceNormals.ComputeFaceNormals()
        m.UnifyNormals()
        m.Normals.ComputeNormals()
        If Not clrB Then m.VertexColors.Clear()
        A = m
      Else
        A = mo
      End If
      E = arrP
    End If
# ---------- m_caps: VB additional code ----------
  Private Function avgC(ByVal R As Double, ByVal G As Double, ByVal B As Double, ByVal T As Integer)

    R /= t
    G /= t
    B /= t
    If R > 255 Then R = 255 Else If R < 0 Then R = 0
    If G > 255 Then G = 255 Else If G < 0 Then G = 0
    If B > 255 Then B = 255 Else If B < 0 Then B = 0

    Return color.FromArgb(CInt(R), CInt(G), CInt(B))
  End Function
# ---------- end m_caps ----------
tri_2 = Triangulate(Mesh=m_caps.A)  # -> Mesh, Count
division_2 = Division(A=number_slider_5, B="2")
Z_6 = UnitZ(Factor=division_2)

explode = Explode(Curve=voronoi, Recursive=True)  # -> Segments, Vertices
dupln = RemoveDuplicateLines(Lines=explode.Segments, Tolerance=0.01)
end = EndPoints(Curve=dupln)  # -> Start, End
vec = Vector(dupln)
unit = UnitVector(Vector=vec)
multiplication_2 = Multiplication(A=unit, B=Slider(50, range=0..100))
Z_7 = UnitZ(Factor=1)
xprod = CrossProduct(VectorA=unit, VectorB=Z_7, Unitize=False)  # -> Vector, Length
neg_4 = Negative(Value=xprod.Vector)

midpt = CurveMiddle(Curve=dupln)

move_4 = Move(Geometry=midpt, Motion=multiplication_2)  # -> Geometry, Transform
line = LineSDL(Start=midpt, Direction=xprod.Vector, Length=mergin)
line_2 = LineSDL(Start=midpt, Direction=neg_4, Length=mergin)
merge_5 = Merge(Data1=line, Data2=line_2)
join_2 = JoinCurves(Curves=merge_5, Preserve=False)
ext = ExtendCurve(Curve=join_2, Type=0, Start=number_slider_6, End=number_slider_6)
meshpipe = MeshPipe(Curve=ext, Radius=Slider(5, range=0..100), Sides=6, Tolerance=10, Ending=3)

move_5 = Move(Geometry=meshpipe, Motion=Z_6)  # -> Geometry, Transform
merge_6 = Merge(Data1=move_5.Geometry, Data2=tri.Mesh, Data3=tri_2.Mesh)  # -> flatten(Result)
munion = MeshUnion(Meshes=merge_6)
