# Grasshopper definition pavilion_model.ghx (Grasshopper 1.0.7)
# plug-ins: Kangaroo2 Components, Weaverbird, NGon

number_slider = Slider(350, range=0..1000)
xy = XYPlane(Origin=Point(0, 0, 0))
sqrt = SquareRoot(Value="2")
division = Division(A=number_slider, B=sqrt)
rectangle = Rectangle(Plane=xy, XSize=number_slider, YSize=division, Radius=0)  # -> Rectangle, Length

xy_2 = XYPlane(Origin=Point(0, 0, 0))
number_slider_2 = Slider(1800, range=0..10000)
number_slider_3 = Slider(6, range=0..10)
rectangle_2 = Rectangle(Plane=xy_2, XSize=number_slider_2, YSize=number_slider_2, Radius=0)  # -> Rectangle, Length

division_2 = Division(A=Slider(400, range=0..1000), B=2)
division_3 = Division(A=Slider(280, range=0..1000), B=2)
neg = Negative(Value=division_2)
neg_2 = Negative(Value=division_3)
area = Area(Geometry=rectangle.Rectangle)  # -> Area, Centroid
dom = ConstructDomain(DomainStart=neg_2, DomainEnd=division_3)
dom_2 = ConstructDomain(DomainStart=neg, DomainEnd=division_2)
rectangle_3 = Rectangle(Plane=area.Centroid, XSize=dom_2, YSize=dom, Radius=0)  # -> Rectangle, Length

offset = OffsetCurve(Curve=rectangle_2.Rectangle, Distance=expr("-x", Slider(300, range=0..1000)), Corners=1)
pop2d = Populate2D(Region=offset, Count=number_slider_3, Seed=Slider(6, range=1..10))
pop2d_2 = Populate2D(Region=rectangle.Rectangle, Count=Slider(16, range=1..30), Seed=1)
voronoi = Voronoi(Points=pop2d, Boundary=rectangle_2.Rectangle, Plane=xy_2, BruteForceOverride=False)
xy_3 = XYPlane(Origin=pop2d)
mergin = Slider(2, range=0..100)
voronoi_2 = Voronoi(Points=pop2d_2, Boundary=rectangle.Rectangle, Plane=xy, BruteForceOverride=False)

area_2 = Area(Geometry=voronoi_2)  # -> Area, Centroid
crv_cp = CurveClosestPoint(Point=area_2.Centroid, Curve=voronoi_2)  # -> Point, Parameter, Distance
dist = Distance(PointA=area_2.Centroid, PointB=crv_cp.Point)
sort = SortList(Keys=dist)  # -> Keys, ValuesA
item = ListItem(List=sort.Keys, Index=0, Wrap=True)
rad = Radians(Degrees="32")
tan = Tangent(Value=rad)
multiplication = Multiplication(A=item, B=tan)

offset_2 = OffsetCurve(Curve=voronoi_2, Distance=expr("-x", mergin), Plane=xy_3, Corners=0)  # -> flatten(Curve)
random = Random(Range=Domain(0, 1), Number=number_slider_3, Seed=2)
dom_3 = ConstructDomain(DomainStart=Slider(2000, range=0..10000), DomainEnd=Slider(2000, range=0..10000))

Z = UnitZ(Factor=multiplication)
neg_3 = Negative(Value=Z)
move = Move(Geometry=rectangle_3.Rectangle, Motion=neg_3)  # -> Geometry, Transform
number_slider_4 = Slider(4, range=0..10)
boundary = BoundarySurfaces(Edges=move.Geometry)
Z_2 = UnitZ(Factor=number_slider_4)
neg_4 = Negative(Value=Z_2)
extr = Extrude(Base=boundary, Direction=neg_4)

explode = Explode(Curve=rectangle_3.Rectangle, Recursive=True)  # -> Segments, Vertices
divide = DivideCurve(Curve=explode.Segments, Count=Slider(3, range=0..10), Kinks=False)  # -> Points, Tangents, Parameters
number_slider_5 = Slider(2.5, range=0..10)
item_2 = ListItem(List=divide.Points, Index=0, Wrap=True)  # -> Item, Item1, Item2
merge = Merge(Data1=item_2.Item1, Data2=item_2.Item2)
offset_3 = OffsetCurve(Curve=rectangle.Rectangle, Distance=number_slider_5, Corners=1)
crv_cp_2 = CurveClosestPoint(Point=merge, Curve=offset_3)  # -> Point, Parameter, Distance
ln = Line(StartPoint=merge, EndPoint=crv_cp_2.Point)

remap = RemapNumbers(Value=random, Source=Domain(0, 1), Target=dom_3)  # -> Mapped, Clipped
number_slider_6 = Slider(3, range=0..100)
number_slider_7 = Slider(30, range=0..1000)
area_3 = Area(Geometry=offset_2)  # -> Area, Centroid
cir = Circle(Plane=area_3.Centroid, Radius=number_slider_6)
multiplication_2 = Multiplication(A=number_slider_6, B=Slider(1.2, range=1..2))
division_4 = Division(A=multiplication, B=Slider(3, range=0..10))
Z_3 = UnitZ(Factor=Slider(10, range=0..100))
offset_4 = OffsetCurve(Curve=cir, Distance=multiplication_2, Corners=1)
Z_4 = UnitZ(Factor=division_4)
Z_5 = UnitZ(Factor=multiplication)
division_5 = Division(A=number_slider_5, B=2)
neg_5 = Negative(Value=division_5)
extr_2 = Extrude(Base=offset_2, Direction=Z_3)
neg_6 = Negative(Value=Z_4)
neg_7 = Negative(Value=Z_5)
cap = CapHoles(Brep=extr_2)
Z_6 = UnitZ(Factor=remap.Mapped)
offset_5 = OffsetCurve(Curve=ln, Distance=division_5, Corners=1)
offset_6 = OffsetCurve(Curve=ln, Distance=neg_5, Corners=1)
move_2 = Move(Geometry=cir, Motion=neg_7)  # -> Geometry, Transform
move_3 = Move(Geometry=offset_4, Motion=neg_6)  # -> Geometry, Transform
move_4 = Move(Geometry=cap, Motion=Z_6)  # -> Geometry, Transform
end = EndPoints(Curve=offset_5)  # -> Start, End
end_2 = EndPoints(Curve=offset_6)  # -> Start, End
volume = Volume(Geometry=move_4.Geometry)  # -> Volume, Centroid
explode_2 = Explode(Curve=offset_3, Recursive=True)  # -> Segments, Vertices
merge_2 = Merge(Data1=simplify(graft(offset_2)), Data2=simplify(move_3.Geometry))
ln_2 = Line(StartPoint=end.End, EndPoint=end_2.End)
ln_3 = Line(StartPoint=end.Start, EndPoint=end_2.Start)
merge_3 = Merge(Data1=simplify(move_3.Geometry), Data2=simplify(graft(move_2.Geometry)))
loft_opt = LoftOptions(Closed=False, Adjust=True, Rebuild=0, Refit=0, Type=0)
item_3 = ListItem(List=explode_2.Segments, Index=0, Wrap=True)  # -> Item, Item1, Item2, Item3
neg_8 = Negative(Value=number_slider_4)
merge_4 = Merge(Data1=offset_5, Data2=ln_3, Data3=offset_6, Data4=ln_2)
ext = ExtendCurve(Curve=[item_3.Item1, item_3.Item3], Type=0, Start=neg_8, End=neg_8)
loft = Loft(Curves=merge_2, Options=loft_opt)
loft_2 = Loft(Curves=merge_3, Options={Adjust=False, Closed=False, LoftEnds=0, LoftSimp=0, LoftType=0, Rebuild=10, Refit=0.01})
join = JoinCurves(Curves=merge_4, Preserve=False)
merge_5 = Merge(Data1=item_3.Item, Data2=item_3.Item2, Data3=ext)
boundary_2 = BoundarySurfaces(Edges=join)
merge_6 = Merge(Data1=loft, Data2=loft_2)
offset_7 = OffsetCurve(Curve=merge_5, Distance=neg_8, Corners=1)
move_5 = Move(Geometry=boundary_2, Motion=neg_3)  # -> Geometry, Transform
join_2 = BrepJoin(Breps=merge_6)  # -> Breps, Closed
merge_7 = Merge(Data1=graft(merge_5), Data2=offset_7)
mesh = MeshBrep(
    Brep=join_2.Breps,
    Settings={GridMaxCount=0, GridMinCount=16, JaggedSeams=False, MaxEdgeLength=0, MinEdgeLength=0.0001, MinTolerance=0, Refine=True, RefineAngle=0, RelativeTolerance=0.65, SimplePlanes=True, Tolerance=0})
number_slider_8 = Slider(100, range=0..1000)
item_4 = ListItem(List=merge_7, Index=0, Wrap=True)  # -> Item, Item1
triremesh = TriRemesh(Geometry=mesh, Length=Slider(3, range=0..10), Iterations=Slider(25, range=0..100))  # -> Triangulation, Dual, Creases
Z_7 = UnitZ(Factor=number_slider_8)
neg_9 = Negative(Value=Z_7)
end_3 = EndPoints(Curve=item_4.Item)  # -> Start, End
end_4 = EndPoints(Curve=item_4.Item1)  # -> Start, End
ln_4 = Line(StartPoint=end_3.End, EndPoint=end_4.End)
ln_5 = Line(StartPoint=end_3.Start, EndPoint=end_4.Start)
merge_8 = Merge(Data1=item_4.Item, Data2=ln_5, Data3=item_4.Item1, Data4=ln_4)
join_3 = JoinCurves(Curves=merge_8, Preserve=False)  # -> flatten(Curves)
nv = NakedVertices(Mesh=triremesh.Triangulation)  # -> ClothedIndex, NakedIndex, ClothedPts, NakedPts
medges = MeshEdges(Mesh=triremesh.Triangulation)  # -> NakedEdges, InteriorEdges, NonManifoldEdges
item_5 = ListItem(List=flatten(join_3), Index=0, Wrap=True)  # -> Item, Item1
project = Project(Curve=join_3, Brep=boundary, Direction=Vector(0, 0, 1))
merge_9 = Merge(Data1=medges.NakedEdges, Data2=medges.InteriorEdges)
pt = Point(nv.NakedPts)
boundary_3 = BoundarySurfaces(Edges=project)
anchor = Anchor(Point=pt, Target=pt, Strength=Slider(100000, range=0..100000))
show = Show(G=triremesh.Triangulation)
length_line = LengthLine(Line=merge_9, Length=Slider(0, range=0..100), Strength=Slider(100, range=0..10000))
entwine = Entwine(Branch00=[anchor, length_line], Branch01=show, FlattenInputs=True)
solver = Solver(GoalObjects=entwine, Reset=Button(), Threshold=1e-15, Tolerance=0.0001, On=Toggle(False))  # -> I, V, O
branch = TreeBranch(Tree=simplify(solver.O), Path="{1}", MaintainPaths=True)
number_slider_9 = Slider(5, range=0..100)
addition = Addition(A=multiplication, B=number_slider_9)

subtraction = Subtraction(A=number_slider_8, B=addition)
subtraction_2 = Subtraction(A=subtraction, B=number_slider_4)
Z_8 = UnitZ(Factor=subtraction_2)
neg_10 = Negative(Value=Z_8)
division_6 = Division(A=subtraction_2, B=2)
division_7 = Division(A=number_slider_4, B=2)
subtraction_3 = Subtraction(A=division_6, B=division_7)
Z_9 = UnitZ(Factor=subtraction_3)
neg_11 = Negative(Value=Z_9)

move_6 = Move(Geometry=extr, Motion=neg_10)  # -> Geometry, Transform
move_7 = Move(Geometry=extr, Motion=neg_11)  # -> Geometry, Transform
Z_10 = UnitZ(Factor=addition)
move_8 = Move(Geometry=move_5.Geometry, Motion=Z_10)  # -> Geometry, Transform
extr_3 = Extrude(Base=move_8.Geometry, Direction=neg_9)
extr_4 = Extrude(Base=boundary_3, Direction=Z_10)
merge_10 = Merge(Data1=extr, Data2=move_6.Geometry, Data3=move_7.Geometry)

Z_11 = UnitZ(Factor=1)
neg_12 = Negative(Value=Z_11)
line = LineSDL(Start=area_2.Centroid, Direction=neg_12, Length=Slider(200, range=0..1000))
pipe = Pipe(Curve=line, Radius=Slider(3, range=0..10), Caps=1)  # -> flatten(Pipe)
sdiff = SolidDifference(BrepsA=merge_10, BrepsB=pipe)

brep = Brep(simplify(extr_3))
sint = SolidIntersection(BrepsA=merge_10, BrepsB=brep)
dam = DataDam(DataA=branch, BufferDelay=10000000, BufferMode=0)
end_5 = EndPoints(Curve=ln)  # -> Start, End
volume_2 = Volume(Geometry=sint)  # -> Volume, Centroid
offsetmesh = OffsetMesh(Mesh=dam, Dist=number_slider_9, Solid=True)
wbnaked = WeaverbirdsNakedBoundary(MeshClosedPolylines=graft(dam))
vec2pt = Vector2Pt(PointA=end_5.Start, PointB=end_5.End, Unitize=False)  # -> Vector, Length
pt_2 = Point(end_5.Start)
subtraction_4 = Subtraction(A=Slider(100, range=0..10000), B=multiplication)
tri = Triangulate(Mesh=offsetmesh)  # -> Mesh, Count
flatten = FlattenTree(Tree=vec2pt.Vector, Path="{0}")  # -> graft(Tree)
flatten_2 = FlattenTree(Tree=pt_2, Path="{0}")  # -> graft(Tree)
item_6 = ListItem(List=wbnaked, Index=0, Wrap=True)  # -> Item, Item1
Z_12 = UnitZ(Factor=subtraction_4)
neg_13 = Negative(Value=Z_12)
pl = PlaneNormal(Origin=volume_2.Centroid, ZAxis=flatten)
vdis = VectorDisplay(Anchor=flatten_2, Vector=flatten)
extr_5 = Extrude(Base=item_6.Item1, Direction=neg_13)
number_slider_10 = Slider(10, range=0..100)
scale_nu = ScaleNU(Geometry=simplify(sint), Plane=simplify(pl), ScaleX=1, ScaleY=1, ScaleZ=Slider(0.5, range=0..1))  # -> Geometry, Transform
mesh_2 = MeshBrep(
    Brep=extr_5,
    Settings={GridMaxCount=0, GridMinCount=16, JaggedSeams=False, MaxEdgeLength=0, MinEdgeLength=0.0001, MinTolerance=0, Refine=True, RefineAngle=0, RelativeTolerance=0.65, SimplePlanes=True, Tolerance=0})
vlen = VectorLength(Vector=flatten)
deplane = DeconstructPlane(Plane=pl)  # -> Origin, XAxis, YAxis, ZAxis
m_caps = MeshCaps(M=mesh_2, W=True, O=True, D=0)  # -> out, A, E; inputs M: Mesh, clr: Color
# ---------- m_caps: VB ----------
    Component.Params.Input(0).Name = "Mesh"
    Component.Params.Input(0).Description = "An open mesh"
    Component.Params.Input(1).Name = "Join and Weld"
    Component.Params.Input(1).Description = "If true the original mesh will be joined and welded to the new caps, else the caps will be output as a list of new meshes"
    Component.Params.Input(2).Name = "Simplify Faces"
    Component.Params.Input(2).Description = "If true, naked edges consisting of 3 to 4 segments will be replaced with a single face, else faces will use new center vertex method"
    Component.Params.Input(3).Name = "Distance (Optional, Rhino Units)"
    Component.Params.Input(3).Description = "A single number which sets the Rhino unit based distance that the center point will be offset from the vertex averages"

    Component.Params.Output(1).Name = "Mesh"
    Component.Params.Output(1).Description = "If successful, a list or single of valid meshes"
    Component.Params.Output(2).Name = "Polylines"
    Component.Params.Output(2).Description = "If successful, a list of valid edge polylines"

    If M IsNot Nothing Then
      Dim i,j,k,kk,ka As Integer
      Dim arrP() As polyline
      Dim P As polyline
      Dim arrM As New list(Of Mesh)
      Dim mj As New mesh
      Dim clrB,clrC,blnN() As Boolean
      Dim oc,tcc As New list(Of color)
      If (clr <> Nothing) Then clrC = True
      If ((m.VertexColors.count() > 0) Or (clr <> Nothing)) Then clrB = True
      If (m.VertexColors.count() = 0) Then  m.vertexcolors.CreateMonotoneMesh(color.LightGray)
      oc = m.VertexColors.ToArray.tolist()
      Dim mv() As point3d
      Dim mo As New list(Of mesh)
      Dim fc As New list(Of MeshFace)
      Dim np As New list(Of point3d)
      Dim ni As New list(Of Integer)
      Dim ind(3) As Integer

      mv = m.Vertices.ToPoint3dArray()
      blnN = m.GetNakedEdgePointStatus()
      arrP = m.GetNakedEdges()

      For i = 0 To ubound(blnN) Step 1
        If blnN(i) Then
          np.add(mv(i))
          ni.add(i)
        End If
      Next

      Dim cld As New pointcloud(np.toarray())
      For i = 0 To ubound(arrP) Step 1
        Dim tm As New mesh
        tm.Vertices.Clear()
        tm.Faces.Clear()

        p = arrP(i)
        If (O And (p.count() < 6)) Then
          ind(0) = ni(cld.ClosestPoint(p(0)))
          ind(1) = ni(cld.ClosestPoint(p(1)))
          ind(2) = ni(cld.ClosestPoint(p(2)))
          ind(3) = ni(cld.ClosestPoint(p(3)))
          tm.Vertices.Add(mv(ind(0)))
          tm.Vertices.Add(mv(ind(1)))
          tm.Vertices.Add(mv(ind(2)))

          tm.VertexColors.Add(oc(ind(0)))
          tm.VertexColors.Add(oc(ind(1)))
          tm.VertexColors.Add(oc(ind(2)))
          If p.count() = 5 Then
            fc.add(New meshface(ind(0), ind(1), ind(2), ind(3)))
            tm.Vertices.Add(mv(ind(3)))
            tm.VertexColors.Add(oc(ind(3)))
            tm.Faces.addface(New meshface(0, 1, 2, 3))
          ElseIf p.count() = 4 Then
            fc.add(New meshface(ind(0), ind(1), ind(2)))
            tm.Faces.addface(New meshface(0, 1, 2))
          End If
          tm.FaceNormals.ComputeFaceNormals()
          tm.Normals.ComputeNormals()
          mo.add(tm)

        Else
          Dim tx As New mesh
          Dim vec As New vector3d
          Dim tv As New list(Of point3d)
          Dim tc As New list(Of color)
          Dim tfc As New list(Of meshface)
          Dim r,g,b As Integer
          Dim tcl As color
          k = cld.ClosestPoint(p(0))
          ka = k
          tx.Vertices.AddVertices(p.ToArray())
          tx.Faces.AddFaces(p.TriangulateClosedPolyline())
          tx.Normals.ComputeNormals()

          vec = tx.Normals(0)

          tv.add(p(0))
          tc.add(oc(k))
          r = oc(ni(k)).R
          g = oc(ni(k)).G
          b = oc(ni(k)).B
          For j = 1 To p.count() - 2 Step 1
            kk = cld.ClosestPoint(p(j))
            fc.add(New meshface(m.Vertices.count(), ni(k), ni(kk)))
            vec += tx.Normals(j)
            k = kk

            tv.add(p(j))
            tc.add(oc(k))
            r += oc(ni(k)).R
            g += oc(ni(k)).G
            b += oc(ni(k)).B
            tfc.add(New meshface(p.count() - 1, j - 1, j))
          Next
          fc.add(New meshface(m.Vertices.count(), ni(k), ni(ka)))
          vec.Unitize()
          vec *= D
          m.Vertices.add(p.CenterPoint() + vec)

          r /= (p.count() - 1)
          g /= (p.count() - 1)
          b /= (p.count() - 1)
          If r > 255 Then r = 255 Else If r < 0 Then r = 0
          If g > 255 Then g = 255 Else If g < 0 Then g = 0
          If b > 255 Then b = 255 Else If b < 0 Then b = 0
          If clrC Then tcl = clr Else tcl = color.FromArgb(r, g, b)
          m.VertexColors.Add(tcl)

          tv.add(p.CenterPoint() + vec)
          tc.add(tcl)
          tfc.add(New meshface(p.count() - 1, p.count() - 2, 0))
          tm.vertices.AddVertices(tv.toarray())
          If clrB Then tm.VertexColors.AppendColors(tc.toarray())
          tm.faces.addfaces(tfc)
          tm.FaceNormals.ComputeFaceNormals()
          tm.Normals.ComputeNormals()
          mo.add(tm)
        End If
      Next

      If w Then
        m.Faces.AddFaces(fc)
        m.FaceNormals.ComputeFaceNormals()
        m.UnifyNormals()
        m.Normals.ComputeNormals()
        If Not clrB Then m.VertexColors.Clear()
        A = m
      Else
        A = mo
      End If
      E = arrP
    End If
# ---------- m_caps: VB additional code ----------
  Private Function avgC(ByVal R As Double, ByVal G As Double, ByVal B As Double, ByVal T As Integer)

    R /= t
    G /= t
    B /= t
    If R > 255 Then R = 255 Else If R < 0 Then R = 0
    If G > 255 Then G = 255 Else If G < 0 Then G = 0
    If B > 255 Then B = 255 Else If B < 0 Then B = 0

    Return color.FromArgb(CInt(R), CInt(G), CInt(B))
  End Function
# ---------- end m_caps ----------
division_8 = Division(A=vlen, B=4)
tri_2 = Triangulate(Mesh=m_caps.A)  # -> Mesh, Count
multiplication_3 = Multiplication(A=division_8, B=deplane.ZAxis)
neg_14 = Negative(Value=multiplication_3)
division_9 = Division(A=number_slider_9, B="2")
Z_13 = UnitZ(Factor=division_9)
move_9 = Move(Geometry=scale_nu.Geometry, Motion=multiplication_3)  # -> Geometry, Transform
move_10 = Move(Geometry=scale_nu.Geometry, Motion=neg_14)  # -> Geometry, Transform
sdiff_2 = SolidDifference(BrepsA=sdiff, BrepsB=flatten(move_10.Geometry))
sdiff_3 = SolidDifference(BrepsA=brep, BrepsB=move_9.Geometry)
brep_2 = Brep(extr_4)

explode_3 = Explode(Curve=voronoi_2, Recursive=True)  # -> Segments, Vertices
dupln = RemoveDuplicateLines(Lines=explode_3.Segments, Tolerance=0.01)
end_6 = EndPoints(Curve=dupln)  # -> Start, End
vec = Vector(dupln)
unit = UnitVector(Vector=vec)
multiplication_4 = Multiplication(A=unit, B=Slider(50, range=0..100))
Z_14 = UnitZ(Factor=1)
xprod = CrossProduct(VectorA=unit, VectorB=Z_14, Unitize=False)  # -> Vector, Length
neg_15 = Negative(Value=xprod.Vector)

midpt = CurveMiddle(Curve=dupln)

move_11 = Move(Geometry=midpt, Motion=multiplication_4)  # -> Geometry, Transform
line_2 = LineSDL(Start=midpt, Direction=xprod.Vector, Length=mergin)
line_3 = LineSDL(Start=midpt, Direction=neg_15, Length=mergin)
merge_11 = Merge(Data1=line_2, Data2=line_3)
join_4 = JoinCurves(Curves=merge_11, Preserve=False)
ext_2 = ExtendCurve(Curve=join_4, Type=0, Start=number_slider_10, End=number_slider_10)
meshpipe = MeshPipe(Curve=ext_2, Radius=Slider(0.5, range=0..100), Sides=6, Tolerance=10, Ending=3)

move_12 = Move(Geometry=meshpipe, Motion=Z_13)  # -> Geometry, Transform
merge_12 = Merge(Data1=move_12.Geometry, Data2=tri.Mesh, Data3=tri_2.Mesh)  # -> flatten(Result)
munion = MeshUnion(Meshes=merge_12)
