# Grasshopper definition projection.ghx (Grasshopper 1.0.7)
# plug-ins: AzureKinect

# ----
# Resolution
panel = Panel("800")
# Projector
panel_2 = Panel("1280")

# ----
# Origin
pt = Point(Point(0, 0, 0))

azurekinect = AzureKinect(Active=False, PointCloud=False, BodyTracker=False, FrameRate=1, DepthMode=3)  # -> Message, PointCloud, SkeletonPoints, SkeletonConnections

# ----
# WXGA
panel_3 = Panel("16")
X = UnitX(Factor=panel_3)
move = Move(Geometry=pt, Motion=X)  # -> Geometry, Transform
Y = UnitY(Factor="10")
move_2 = Move(Geometry=pt, Motion=Y)  # -> Geometry, Transform

# ----
# inch
panel_4 = Panel("59")

# ----
# mm
panel_5 = Panel("25.4")

xy = XYPlane(Origin=pt)
division = Division(A=panel_3, B=2)
division_2 = Division(A="10", B=2)
neg = Negative(Value=division)
neg_2 = Negative(Value=division_2)
dom = ConstructDomain(DomainStart=neg, DomainEnd=division)
dom_2 = ConstructDomain(DomainStart=neg_2, DomainEnd=division_2)
rectangle = Rectangle(Plane=xy, XSize=dom, YSize=dom_2, Radius=0)  # -> Rectangle, Length
multiplication = Multiplication(A=panel_4, B=panel_5)
dist = Distance(PointA=move.Geometry, PointB=move_2.Geometry)
division_3 = Division(A=multiplication, B=dist)
scale = Scale(Geometry=rectangle.Rectangle, Center=pt, Factor=division_3)  # -> Geometry, Transform

_1 = Panel("1327")
Z = UnitZ(Factor=_1)
neg_3 = Negative(Value=Z)
move_3 = Move(Geometry=scale.Geometry, Motion=neg_3)  # -> Geometry, Transform

multiplication_2 = Multiplication(A="10", B=division_3)
division_4 = Division(A=multiplication_2, B=2)
_2 = Panel("69")
subtraction = Subtraction(A=division_4, B=_2)
Y_2 = UnitY(Factor=subtraction)
move_4 = Move(Geometry=move_3.Geometry, Motion=Y_2)  # -> Geometry, Transform

explode = Explode(Curve=move_4.Geometry, Recursive=True)  # -> Segments, Vertices
vec2pt = Vector2Pt(PointA=pt, PointB=explode.Vertices, Unitize=False)  # -> Vector, Length
vdis = VectorDisplay(Anchor=pt, Vector=vec2pt.Vector)

area = Area(Geometry=move_4.Geometry)  # -> Area, Centroid

nfov_high_res_distance_domain = Panel("""640
576""")
pt_2 = Point([Point(0, 328.1282057, 0), Point(3.174953692, 333.3308133, -5.999998027), Point(-3.174953586, 333.3308133, -5.999998027), Point(-6.815562155, 328.1282056, -6.000006654), Point(-3.174953588, 322.9255978, -5.999998025), Point(3.174953695, 322.9255978, -5.999998025), Point(6.815562261, 328.1282056, -6.000006654)])
nfov_low_res_distance_domain = Panel("""320
288""")
split = SplitList(List=pt_2, Index=1)  # -> ListA, ListB
vec2pt_2 = Vector2Pt(PointA=split.ListA, PointB=split.ListB, Unitize=False)  # -> Vector, Length
xy_2 = XYPlane(Origin=area.Centroid)
fol = Panel("""75
65""")
projecta = ProjectAlong(Geometry=split.ListB, Plane=xy_2, Direction=vec2pt_2.Vector)  # -> Geometry, Transform
pline = PolyLine(Vertices=projecta.Geometry, Closed=True)
vec2pt_3 = Vector2Pt(PointA=split.ListA, PointB=projecta.Geometry, Unitize=False)  # -> Vector, Length
vdis_2 = VectorDisplay(Anchor=split.ListA, Vector=vec2pt_3.Vector)

Y_3 = UnitY(Factor="28.6")
neg_4 = Negative(Value=Y_3)
move_5 = Move(Geometry=pt, Motion=neg_4)  # -> Geometry, Transform
subtraction_2 = Subtraction(A="292", B="107.5")
Y_4 = UnitY(Factor="50.4")
move_6 = Move(Geometry=move_5.Geometry, Motion=Y_4)  # -> Geometry, Transform
X_2 = UnitX(Factor="107.5")
X_3 = UnitX(Factor=subtraction_2)
neg_5 = Negative(Value=X_2)
pt_3 = Point(move_6.Geometry)
pt_4 = Point(move_5.Geometry)
move_7 = Move(Geometry=pt_3, Motion=neg_5)  # -> Geometry, Transform
move_8 = Move(Geometry=pt_3, Motion=X_3)  # -> Geometry, Transform
move_9 = Move(Geometry=pt_4, Motion=neg_5)  # -> Geometry, Transform
move_10 = Move(Geometry=pt_4, Motion=X_3)  # -> Geometry, Transform
Z_2 = UnitZ(Factor="210")
move_11 = Move(Geometry=move_9.Geometry, Motion=Z_2)  # -> Geometry, Transform
neg_6 = Negative(Value=Z_2)
X_4 = UnitX(Factor="52.5")
move_12 = Move(Geometry=move_11.Geometry, Motion=X_4)  # -> Geometry, Transform
X_5 = UnitX(Factor="100")
neg_7 = Negative(Value=X_5)
X_6 = UnitX(Factor="222")
neg_8 = Negative(Value=X_6)

move_13 = Move(Geometry=move_7.Geometry, Motion=Z_2)  # -> Geometry, Transform
X_7 = UnitX(Factor="292")
move_14 = Move(Geometry=move_13.Geometry, Motion=X_7)  # -> Geometry, Transform
box = Box2Pt(PointA=move_9.Geometry, PointB=move_14.Geometry, Plane=PlaneXY(0, 0, 0))
debrep = DeconstructBrep(Brep=box)  # -> Faces, Edges, Vertices
item = ListItem(List=debrep.Faces, Index=0, Wrap=True)
Y_5 = UnitY(Factor=1)
neg_9 = Negative(Value=Y_5)
extr = Extrude(Base=item, Direction=neg_9)

Z_3 = UnitZ(Factor="130")

neg_10 = Negative(Value=Z_3)

move_15 = Move(Geometry=move_12.Geometry, Motion=neg_10)  # -> Geometry, Transform

move_16 = Move(Geometry=move_15.Geometry, Motion=X_5)  # -> Geometry, Transform
move_17 = Move(Geometry=move_15.Geometry, Motion=X_6)  # -> Geometry, Transform

Z_4 = UnitZ(Factor="68")
move_18 = Move(Geometry=move_16.Geometry, Motion=Z_4)  # -> Geometry, Transform
neg_11 = Negative(Value=Z_4)

Z_5 = UnitZ(Factor="42")

neg_12 = Negative(Value=Z_5)

move_19 = Move(Geometry=move_17.Geometry, Motion=neg_12)  # -> Geometry, Transform

wfov_high_res_distance_domain = Panel("""250
2210""")
pdecon = Deconstruct(Point=area.Centroid)  # -> XComponent, YComponent, ZComponent
pt_5 = ConstructPoint(XCoordinate=pdecon.XComponent, YCoordinate=pdecon.YComponent, ZCoordinate=0)
abs = Absolute(Value=pdecon.ZComponent)
sqrt = SquareRoot(Value="3")
division_5 = Division(A=abs, B=sqrt)
wfov_low_res_distance_domain = Panel("""250
2880""")
xy_3 = XYPlane(Origin=pt_5)
Z_6 = UnitZ(Factor=pdecon.ZComponent)
fol_2 = Panel("""120
120""")

multiplication_3 = Multiplication(A=abs, B=sqrt)

cone = Cone(Base=xy_3, Radius=multiplication_3, Length=abs)  # -> Cone, Tip
move_20 = Move(Geometry=cone.Cone, Motion=Z_6)  # -> Geometry, Transform
debrep_2 = DeconstructBrep(Brep=move_20.Geometry)  # -> Faces, Edges, Vertices
shift = ShiftList(List=debrep_2.Edges, Shift=1, Wrap=False)
divide = DivideCurve(Curve=shift, Count=10, Kinks=False)  # -> Points, Tangents, Parameters
vec2pt_4 = Vector2Pt(PointA=pt_5, PointB=divide.Points, Unitize=False)  # -> Vector, Length
vdis_3 = VectorDisplay(Anchor=pt_5, Vector=vec2pt_4.Vector)
