# Grasshopper definition slab_formwork_1to1.ghx (Grasshopper 1.0.7)

number_slider = Slider(900, range=0..1000)
rectangle = Rectangle(Plane=PlaneXY(0, 0, 0), XSize=number_slider, YSize=number_slider, Radius=0)  # -> Rectangle, Length
Z = UnitZ(Factor="18")
neg = Negative(Value=Z)
extr = Extrude(Base=rectangle.Rectangle, Direction=neg)
cap = CapHoles(Brep=extr)

area = Area(Geometry=rectangle.Rectangle)  # -> Area, Centroid

division = Division(A=number_slider, B=2)
subtraction = Subtraction(A=division, B=Slider(50, range=0..100))
polygon = Polygon(Plane=area.Centroid, Radius=subtraction, Segments="6", FilletRadius=0)  # -> Polygon, Length

cir = Circle(Plane=area.Centroid, Radius=Slider(54, range=0..100))
extr_2 = Extrude(Base=cir, Direction=neg)
cap_2 = CapHoles(Brep=extr_2)

division_2 = Division(A=polygon.Length, B="6")
panel = Panel(division_2)

explode = Explode(Curve=polygon.Polygon, Recursive=True)  # -> Segments, Vertices
offset = OffsetCurve(Curve=explode.Segments, Distance="12", Corners=1)
merge = Merge(Data1=simplify(graft(explode.Segments)), Data2=simplify(offset))
loft = Loft(Curves=merge, Options={Adjust=False, Closed=False, LoftEnds=0, LoftSimp=0, LoftType=0, Rebuild=10, Refit=0.01})
Z_2 = UnitZ(Factor="150")
extr_3 = Extrude(Base=loft, Direction=Z_2)

line = Line(explode.Segments)
vec = Vector(line)
unit = UnitVector(Vector=vec)
end = EndPoints(Curve=line)  # -> Start, End
multiplication = Multiplication(A=unit, B="30")
neg_2 = Negative(Value=multiplication)
move = Move(Geometry=end.Start, Motion=multiplication)  # -> Geometry, Transform
move_2 = Move(Geometry=end.End, Motion=neg_2)  # -> Geometry, Transform
ln = Line(StartPoint=end.Start, EndPoint=move.Geometry)
ln_2 = Line(StartPoint=end.End, EndPoint=move_2.Geometry)
merge_2 = Merge(Data1=graft(ln), Data2=graft(ln_2))  # -> flatten(Result)
join = JoinCurves(Curves=merge_2, Preserve=False)  # -> simplify(Curves)
offset_2 = OffsetCurve(Curve=join, Distance="12", Corners=1)  # -> simplify(Curve)
number_slider_2 = Slider(30, range=0..100)
offset_3 = OffsetCurve(Curve=offset_2, Distance=Slider(5, range=0..10), Corners=1)  # -> simplify(Curve)
merge_3 = Merge(Data1=offset_3, Data2=offset_2)
Z_3 = UnitZ(Factor=number_slider_2)
loft_2 = Loft(Curves=merge_3, Options={Adjust=False, Closed=False, LoftEnds=0, LoftSimp=0, LoftType=0, Rebuild=10, Refit=0.01})
neg_3 = Negative(Value=Z_3)
multiplication_2 = Multiplication(A=number_slider_2, B=2)
extr_4 = Extrude(Base=loft_2, Direction=neg_3)
extr_5 = Extrude(Base=loft_2, Direction=Z_3)
subtraction_2 = Subtraction(A="3", B=1)
subtraction_3 = Subtraction(A="150", B=multiplication_2)
merge_4 = Merge(Data1=extr_5, Data2=extr_4)
division_3 = Division(A=subtraction_3, B=subtraction_2)
sunion = SolidUnion(Breps=merge_4)
series = Series(Start=number_slider_2, Step=division_3, Count="3")
Z_4 = UnitZ(Factor=series)
move_3 = Move(Geometry=sunion, Motion=Z_4)  # -> Geometry, Transform

sdiff = SolidDifference(BrepsA=cap, BrepsB=cap_2)

extr_6 = Extrude(Base=polygon.Polygon, Direction=Z_2)
cap_3 = CapHoles(Brep=extr_6)
volume = Volume(Geometry=cap_3)  # -> Volume, Centroid
pow = Power(A="10", B="3")
division_4 = Division(A=volume.Volume, B=pow)
比重_g_cm3 = Panel("1.6")
cm3 = Panel(division_4)
multiplication_3 = Multiplication(A=比重_g_cm3, B=cm3)
division_5 = Division(A=multiplication_3, B="1000")
kg = Panel(division_5)

md_slider = MDSlider(SliderMode=0, slider_value=Point(0.5, 0.5, 0.5), x_domain=Domain(0, 1), y_domain=Domain(0, 1), z_domain=Domain(0, 1))

addition = Addition(A="30", B="50")
multiplication_4 = Multiplication(A=unit, B=addition)
neg_4 = Negative(Value=multiplication_4)
midpt = CurveMiddle(Curve=line)
move_4 = Move(Geometry=end.Start, Motion=multiplication_4)  # -> Geometry, Transform
move_5 = Move(Geometry=end.End, Motion=neg_4)  # -> Geometry, Transform
merge_5 = Merge(Data1=graft(move_4.Geometry), Data2=graft(midpt), Data3=graft(move_5.Geometry))
Z_5 = UnitZ(Factor=1)
xprod = CrossProduct(VectorA=unit, VectorB=Z_5, Unitize=False)  # -> Vector, Length
Z_6 = UnitZ(Factor=1)
line_2 = LineSDL(Start=merge_5, Direction=graft(xprod.Vector), Length="30")
line_3 = LineSDL(Start=merge_5, Direction=Z_6, Length="30")
flip = FlipCurve(Curve=line_3)  # -> Curve, Flag
merge_6 = Merge(Data1=flip.Curve, Data2=line_2)
multiplication_5 = Multiplication(A=unit, B=Slider(20, range=0..100))
neg_5 = Negative(Value=multiplication_5)
division_6 = Division(A=multiplication_5, B=2)
move_6 = Move(Geometry=merge_6, Motion=graft(division_6))  # -> Geometry, Transform
extr_7 = Extrude(Base=move_6.Geometry, Direction=graft(neg_5))
multiplication_6 = Multiplication(A=xprod.Vector, B="12")

evalsrf = EvaluateSurface(Surface=reparameterize(extr_7), Point=md_slider)  # -> Point, Normal, UDirection, VDirection, Frame

multiplication_7 = Multiplication(A=evalsrf.Normal, B="3")
extr_8 = Extrude(Base=extr_7, Direction=multiplication_7)
pshift = ShiftPaths(Data=extr_8, Offset=-1)
sunion_2 = SolidUnion(Breps=extr_8)
move_7 = Move(Geometry=sunion_2, Motion=graft(multiplication_6))  # -> Geometry, Transform
