# Grasshopper definition tool_design.ghx (Grasshopper 1.0.7)

knob = ControlKnob(Decimals=0, Limit=False, Maximum=360, Minimum=0, Range=360, Value=0)

number_slider = Slider(70, range=0..100)
pt = Point(<point referenced from the Rhino model>)
subtraction = Subtraction(A=number_slider, B=Slider(10, range=0..10))
Z = UnitZ(Factor=subtraction)
move = Move(Geometry=pt, Motion=Z)  # -> Geometry, Transform
rad = Radians(Degrees=knob)
yz = YZPlane(Origin=pt)
rotate = Rotate(Geometry=move.Geometry, Angle=rad, Plane=yz)  # -> Geometry, Transform

number_slider_2 = Slider(150, range=0..1000)
Z_2 = UnitZ(Factor=1)
yz_2 = YZPlane(Origin=rotate.Geometry)
neg = Negative(Value=Z_2)
line = LineSDL(Start=pt, Direction=neg, Length=expr("x*2", number_slider_2))
cir = Circle(Plane=yz_2, Radius=number_slider_2)
ccx = CurveCurve(CurveA=cir, CurveB=line)  # -> Points, ParamsA, ParamsB

Z_3 = UnitZ(Factor=Slider(200, range=0..1000))
neg_2 = Negative(Value=Z_3)
move_2 = Move(Geometry=ccx.Points, Motion=neg_2)  # -> Geometry, Transform
xy = XYPlane(Origin=move_2.Geometry)
cyl = Cylinder(Base=xy, Radius=Slider(45, range=0..100), Length=expr("-x", Slider(20, range=0..100)))
ln = Line(StartPoint=rotate.Geometry, EndPoint=ccx.Points)
ln_2 = Line(StartPoint=ccx.Points, EndPoint=move_2.Geometry)

number_slider_3 = Slider(10, range=0..10)
number_slider_4 = Slider(5, range=0..10)
cir_2 = Circle(Plane=yz, Radius=number_slider)
X = UnitX(Factor=number_slider_3)
extr = Extrude(Base=cir_2, Direction=X)

number_slider_5 = Slider(3, range=0..10)
addition = Addition(A=number_slider, B=number_slider_5)
cir_3 = Circle(Plane=yz, Radius=addition)

number_slider_6 = Slider(5, range=0..10)
pipe = Pipe(Curve=ln, Radius=number_slider_6, Caps=0)
pipe_2 = Pipe(Curve=ln_2, Radius=Slider(12.5, range=0..100), Caps=0)
cap = CapHoles(Brep=cyl)

addition_2 = Addition(A=number_slider_3, B=number_slider_6)
addition_3 = Addition(A=addition_2, B=number_slider_4)
X_2 = UnitX(Factor=addition_3)
move_3 = Move(Geometry=extr, Motion=expr("-x", X_2))  # -> Geometry, Transform

multiplication = Multiplication(A=number_slider_6, B=2)
merge = Merge(Data1=number_slider_5, Data2=number_slider_3, Data3=number_slider_4, Data4=multiplication, Data5=number_slider_4)
move_4 = Move(Geometry=cir_3, Motion=expr("-x*1.2", X_2))  # -> Geometry, Transform
ma = MassAddition(Input=merge)  # -> Result, PartialResults
X_3 = UnitX(Factor=ma.Result)
extr_2 = Extrude(Base=move_4.Geometry, Direction=X_3)
cap_2 = CapHoles(Brep=extr_2)

cap_3 = CapHoles(Brep=move_3.Geometry)

merge_2 = Merge(Data1=pipe, Data2=cap_3, Data3=pipe_2, Data4=cap)
preview = CustomPreview(Geometry=merge_2, Material=ColourSwatch(SwatchColor=RGB(122, 122, 122)))
