# Grasshopper definition topos_fin.ghx (Grasshopper 1.0.7)
# Copyright: Sebastian Białkowski
# plug-ins: tOpos

crv = Curve([<curve referenced from the Rhino model> x7])
crv_2 = Curve([<curve referenced from the Rhino model> x16])
crv_3 = Curve(<curve referenced from the Rhino model>)
number_slider = Slider(0.1, range=0..0.1)
pipe = Pipe(Curve=crv_2, Radius=1, Caps=1)
pipe_2 = Pipe(Curve=crv, Radius=1, Caps=1)
pipe_3 = Pipe(Curve=crv_3, Radius=1, Caps=1)
mesh = Mesh(<mesh referenced from the Rhino model>)
mesh_2 = MeshBrep(
    Brep=pipe,
    Settings={GridMaxCount=0, GridMinCount=16, JaggedSeams=False, MaxEdgeLength=0, MinEdgeLength=0.0001, MinTolerance=0, Refine=True, RefineAngle=0, RelativeTolerance=0.65, SimplePlanes=True, Tolerance=0})  # -> flatten(Mesh)
mesh_3 = MeshBrep(
    Brep=pipe_2,
    Settings={GridMaxCount=0, GridMinCount=16, JaggedSeams=False, MaxEdgeLength=0, MinEdgeLength=0.0001, MinTolerance=0, Refine=True, RefineAngle=0, RelativeTolerance=0.65, SimplePlanes=True, Tolerance=0})
mesh_4 = MeshBrep(
    Brep=pipe_3,
    Settings={GridMaxCount=0, GridMinCount=16, JaggedSeams=False, MaxEdgeLength=0, MinEdgeLength=0.0001, MinTolerance=0, Refine=True, RefineAngle=0, RelativeTolerance=0.65, SimplePlanes=True, Tolerance=0})
Z = UnitZ(Factor=Slider(2, range=0..10))
bbox = BoundingBox(Content=mesh, Plane=PlaneXY(0, 0, 0))  # -> Box, Box_2
neg = Negative(Value=Z)
mesh_5 = MeshBrep(
    Brep=bbox.Box,
    Settings={GridMaxCount=0, GridMinCount=16, JaggedSeams=False, MaxEdgeLength=0, MinEdgeLength=0.0001, MinTolerance=0, Refine=True, RefineAngle=0, RelativeTolerance=0.65, SimplePlanes=True, Tolerance=0})
vl = VolumeLoad(LoadMesh=mesh_2, LoadVector=neg)
merge = Merge(Data1=mesh_3)  # -> flatten(Result)
bdomain = BoundaryDomain(
    DomainMesh=mesh_5,
    DensityValue=number_slider,
    YoungModul=Slider(210, range=0..1000),
    PoissonNumber=Slider(0.3, range=0..1))
res = Resolution(ResolutionX=Slider(150, range=0..1000), sizeModeToggle=False)
bcond = BoundaryConditions(Load=vl, Support=merge)
oparam = OptimiusParameters(
    OptimisationIteration=Slider(30, range=0..100),
    VolumeFraction=number_slider,
    Penalty=Domain(2, 3),
    Change=0.005,
    SensitivityFilterRadius=Domain(1.5, 1.5),
    DensityFilterType=0,
    GrayScaleFilter=False,
    HeavisideProjection=0,
    SensitivityFilterType=1)
aparam = AnalyserParameters(Iterations=4000, Tolerance=0.001)
model = Model(BoundaryDomain=bdomain, BoundaryCondition=bcond, ModelResolution=res, gpuModeToggle=False)  # -> Model, Performance
optimus = Optimus(
    Model=model.Model,
    AnalyserParameters=aparam,
    OptimusParameters=oparam,
    SubdivisionThreshold=0.5,
    Reset=Button(),
    Run=Toggle(False),
    optimisationPreviewMode=False,
    solverType=0)  # -> Model, Compliance, Performance

# ---- group: Optimisation process
graph = QuickGraph(optimus.Compliance, SortOrder=0)

# ---- group: Vis
number_slider_2 = Slider(2.6, range=0..10)
pstress = PrincipalStress(Model=optimus.Model, Tolerance=0)  # -> PStressValues, PStressPlane, PStressCrosses, PStressCrossesColours, PStressMinMax, VonMiesesValues, VonMiesesCrossesColours, Performance
iso = IsoMesh(Model=optimus.Model, IsoValue=Slider(0.442, range=0..1), Deflection=0)

# ---- group: Performance Data
perf = Performance(Performance=optimus.Performance)  # -> TotalData, EventsNames, Times, Memory, Solver
panel = Panel(perf.TotalData)

# ----
elepre = ElementDataPreview(model=optimus.Model, iso=0.02, move=number_slider_2)  # -> element_location, colours, colour_range
denspre = DensPreview(model=optimus.Model, iso=0.01)

# ---- group: Nicer Preview for mesh
medges = MeshEdges(Mesh=iso)  # -> NakedEdges, InteriorEdges, NonManifoldEdges; disabled
swatch = ColourSwatch(SwatchColor=RGB(192, 235, 0))  # disabled
swatch_2 = ColourSwatch(SwatchColor=RGB(91, 221, 255))  # disabled
merge_2 = Merge(Data1=medges.NakedEdges, Data2=medges.InteriorEdges)  # disabled
entwine = Entwine(Branch00=merge_2, Branch01=iso, FlattenInputs=True)  # disabled
entwine_2 = Entwine(Branch00=swatch, Branch01=swatch_2, FlattenInputs=True)  # disabled
preview = CustomPreview(Geometry=entwine, Shader=entwine_2)  # disabled

# ==== cluster ElementDataPreview: Dot style preview of tOpos Model data including element Density, Compliance and Sensitivity
model = ClusterInput()  # tOpos Model to generate preview
iso = ClusterInput()  # Iso Threshold
move = ClusterInput()  # Space between particular data sets
M = Data(model)
iso_2 = Number(iso)
num = Number(move)
dom = ConstructDomain(DomainStart=0, DomainEnd=1)

element = ElementResult(Model=M, densityMode=False)  # -> Location, Density, Compliance, Sensitivity, Size
larger = LargerThan(FirstNumber=element.Density, SecondNumber=iso_2)  # -> LargerThan, OrEqualTo
dotsize = Slider(0.6, range=0..1)
cull = CullPattern(List=element.Location, CullPattern=larger.LargerThan)
multiplication = Multiplication(A=element.Size, B=dotsize)
bbox = BoundingBox(Content=cull, Plane=PlaneXY(0, 0, 0), UnionBox=True)  # -> Box, Box_2
boxprop = BoxProperties(Box=bbox.Box)  # -> Center, Diagonal, Area, Volume, Degeneracy
devec = DeconstructVector(Vector=boxprop.Diagonal)  # -> XComponent, YComponent, ZComponent
addition = Addition(A=num, B=devec.XComponent)
series = Series(Start=0, Step=addition, Count=3)
X = UnitX(Factor=series)
move_2 = Move(Geometry=cull, Motion=graft(X))  # -> simplify(Geometry), Transform

cull_2 = CullPattern(List=element.Density, CullPattern=larger.LargerThan)
gradient = Gradient(LowerLimit=0, UpperLimit=1, Parameter=cull_2, stops=[0: RGBA(255, 255, 255, 0), 1: RGB(0, 0, 0)])

bnd = Bounds(Numbers=element.Compliance)
cull_3 = CullPattern(List=element.Compliance, CullPattern=larger.LargerThan)
dedomain = DeconstructDomain(Domain=bnd)  # -> Start, End
gradient_2 = Gradient(
    LowerLimit=dedomain.Start,
    UpperLimit=dedomain.End,
    Parameter=cull_3,
    stops=[0.00371: RGBA(176, 53, 53, 0), 0.102: RGB(255, 250, 98), 0.5: RGB(46, 144, 208)])

bnd_2 = Bounds(Numbers=element.Sensitivity)
cull_4 = CullPattern(List=element.Sensitivity, CullPattern=larger.LargerThan)
dedomain_2 = DeconstructDomain(Domain=bnd_2)  # -> Start, End
gradient_3 = Gradient(
    LowerLimit=dedomain_2.Start,
    UpperLimit=dedomain_2.End,
    Parameter=cull_4,
    stops=[0.502: RGB(175, 53, 52), 0.895: RGB(255, 250, 98), 1: RGBA(46, 144, 209, 0)])

entwine = Entwine(Branch00=gradient, Branch01=gradient_2, Branch02=gradient_3, FlattenInputs=True)  # -> simplify(Result)

cloud = CloudDisplay(Points=move_2.Geometry, Colours=entwine, Size=multiplication, SpriteType=1)

pt = Point(cull)
col = Colour(entwine)
merge = Merge(Data1=flatten(dom), Data2=flatten(bnd), Data3=flatten(bnd_2))  # -> graft(Result)
range = Domain(merge)
element_location = ClusterOutput(pt)  # Element location (center) after culling by Iso parameter.
colours = ClusterOutput(col)  # Colous for each element (after culling by Iso Threshold) of particular data sets (dens, colpiance, sensitivity)
colour_range = ClusterOutput(range)  # Colour range of particular data sets (dens, colpiance, sensitivity) for creating legend

# ==== cluster DensPreview: Preview densities as a Blured Point Cloud
model = ClusterInput()  # tOpos Model
iso = ClusterInput()  # Iso Threshold
element = ElementData(Model=model, densityMode=False)  # -> Location, Density, Compliance, Sensitivity, Size
iso_2 = Number(iso)
larger = LargerThan(FirstNumber=element.Density, SecondNumber=iso_2)  # -> LargerThan, OrEqualTo
cull = CullPattern(List=element.Density, CullPattern=larger.LargerThan)
cull_2 = CullPattern(List=element.Location, CullPattern=larger.LargerThan)
gradient = Gradient(LowerLimit=0, UpperLimit=1, Parameter=cull, stops=[0: RGBA(255, 255, 255, 0), 0.462: RGB(0, 0, 0)])
cloud = CloudDisplay(Points=cull_2, Colours=gradient, Size=expr("x/2", element.Size), SpriteType=1)
